# Grasshopper definition Configuration _ 3D.gh (Grasshopper 1.0.7)
# plug-ins: Bifocals, LunchBox, Human

version5 = FilePath("C:\Users\Mariana\[ Mariana ]\[ TUDelft ]\[ 5th Quarter ]\EARTHY& SWAT\01 Configuring\PYTHON\export_ALL_v5.csv")
version1 = FilePath("C:\Users\Mariana\[ Mariana ]\[ TUDelft ]\[ 5th Quarter ]\EARTHY& SWAT\01 Configuring\PYTHON\export_ALL_v1.csv")
version6 = FilePath("C:\Users\Mariana\[ Mariana ]\[ TUDelft ]\[ 5th Quarter ]\EARTHY& SWAT\01 Configuring\PYTHON\export_ALL_v6.csv")
version3 = FilePath("C:\Users\Mariana\[ Mariana ]\[ TUDelft ]\[ 5th Quarter ]\EARTHY& SWAT\01 Configuring\PYTHON\export_ALL_v3.csv")
version4 = FilePath("C:\Users\Mariana\[ Mariana ]\[ TUDelft ]\[ 5th Quarter ]\EARTHY& SWAT\01 Configuring\PYTHON\export_ALL_v4.csv")
version2 = FilePath("C:\Users\Mariana\[ Mariana ]\[ TUDelft ]\[ 5th Quarter ]\EARTHY& SWAT\01 Configuring\PYTHON\export_ALL_v2.csv")
version7 = FilePath("C:\Users\Mariana\[ Mariana ]\[ TUDelft ]\[ 5th Quarter ]\EARTHY& SWAT\01 Configuring\PYTHON\export_ALL_v7.csv")
version8 = FilePath("C:\Users\Mariana\[ Mariana ]\[ TUDelft ]\[ 5th Quarter ]\EARTHY& SWAT\01 Configuring\PYTHON\export_ALL_v8.csv")

# ---- group: First Grid
# EARTHY 2021
# 
# Group 8:
# CLOUD MATRIX
# 
# Authors:
# Anna Maria Koniari | Dimitrios Ntoupas | Kwan-Lin Wang | Mariana Georgoulopoulou | Vasilka Espinosa
number_slider = Slider(1, range=0..1)
rectangle = Rectangle(Plane=PlaneXY(0, 0, 0), XSize=number_slider, YSize=number_slider, Radius=0)  # -> Rectangle, Length
arrrec = RectangularArray(
    Geometry=rectangle.Rectangle,
    Cell=rectangle.Rectangle,
    XCount=Slider(98, range=0..100),
    YCount=Slider(-35, range=-84..100))  # -> Geometry, Transform
Y = UnitY(Factor=Slider(35, range=0..100))
move = Move(Geometry=arrrec.Geometry, Motion=Y)  # -> Geometry, Transform
boundary = BoundarySurfaces(Edges=move.Geometry)

# ----
variations = Slider(10, range=1..10)
height = Slider(1.8, range=0..10)

# ---- group: Import CSV
item = ListItem(List=[version1, version2, version3, version4, version5, version6, version7, version8], Index=variations, Wrap=True)
file = ReadFile(File=item, PerLineParse=True)
csv = ReadCSV(CSVString=file, Delimiter=",")  # -> Headers, flatten(Values)

# ---- group: FUNCTIONS
courtyard = Courtyard(L=boundary, S=csv.Values, M=["12", "1"])
corridor = Courtyard(L=boundary, S=csv.Values, M=["2", "8"])
joker = Courtyard(L=boundary, S=csv.Values, M="3")
wc = Courtyard(L=boundary, S=csv.Values, M="4")
first_aid = Courtyard(L=boundary, S=csv.Values, M="5")
kitchen = Courtyard(L=boundary, S=csv.Values, M="6")
changing_rooms_canteen = Courtyard(L=boundary, S=csv.Values, M="7")
administration = Courtyard(L=boundary, S=csv.Values, M="9")
sitting_area = Courtyard(L=boundary, S=csv.Values, M="10")
playground = Courtyard(L=boundary, S=csv.Values, M="11")
classroom = Courtyard(L=boundary, S=csv.Values, M=["14", "15"])
stairs = Courtyard(L=boundary, S=csv.Values, M="16")

# ---- group: Second floor
smaller = SmallerThan(FirstNumber=wc, SecondNumber="32")  # -> SmallerThan, OrEqualTo
cull = CullPattern(List=wc, CullPattern=smaller.SmallerThan)
Z = UnitZ(Factor=height)
move_2 = Move(Geometry=cull, Motion=Z)  # -> Geometry, Transform

corridor_2 = Courtyard(L=boundary, S=csv.Values, M="13")
Z_2 = UnitZ(Factor=height)
move_3 = Move(Geometry=corridor_2, Motion=Z_2)  # -> Geometry, Transform

Z_3 = UnitZ(Factor=height)
move_4 = Move(Geometry=joker, Motion=Z_3)  # -> Geometry, Transform

Z_4 = UnitZ(Factor=height)
move_5 = Move(Geometry=stairs, Motion=Z_4)  # -> Geometry, Transform

Z_5 = UnitZ(Factor=height)
move_6 = Move(Geometry=classroom, Motion=Z_5)  # -> flatten(Geometry), Transform

# ---- group: ADMINISTRATION
X = UnitX(Factor=1)
srf = Surface(graft(administration))
in_case_of_doubles = InCaseOfDoubles(B=srf, U="0 To 4", D=X, V="0 To 8", B_2=Slider(7, range=0..10))

# ---- group: WC
X_2 = UnitX(Factor=1)
srf_2 = Surface(graft(wc))
in_case_of_doubles_2 = InCaseOfDoubles(B=srf_2, U="0 To 6", D=X_2, V="0 To 4", B_2=Slider(8, range=0..10))

srf_3 = Surface(graft(move_2.Geometry))
X_3 = UnitX(Factor=1)
in_case_of_doubles_3 = InCaseOfDoubles(B=srf_3, U="0 To 6", D=X_3, V="0 To 4", B_2=Slider(7, range=0..10))

# ---- group: PLOT Configuration
preview = CustomPreview(Geometry=courtyard, Material=ColourSwatch(SwatchColor=RGB(135, 101, 27)))
preview_2 = CustomPreview(Geometry=[corridor_2, corridor, move_3.Geometry], Material=ColourSwatch(SwatchColor=RGB(20, 79, 9)))
preview_3 = CustomPreview(Geometry=[joker, move_4.Geometry], Material=ColourSwatch(SwatchColor=RGB(42, 65, 235)))
preview_4 = CustomPreview(Geometry=[move_2.Geometry, wc], Material=ColourSwatch(SwatchColor=RGB(180, 95, 217)))
preview_5 = CustomPreview(Geometry=first_aid, Material=ColourSwatch(SwatchColor=RGB(145, 63, 141)))
preview_6 = CustomPreview(Geometry=kitchen, Material=ColourSwatch(SwatchColor=RGB(44, 153, 139)))
preview_7 = CustomPreview(Geometry=changing_rooms_canteen, Material=ColourSwatch(SwatchColor=RGB(120, 62, 62)))
preview_8 = CustomPreview(Geometry=administration, Material=ColourSwatch(SwatchColor=RGB(158, 142, 22)))
preview_9 = CustomPreview(Geometry=sitting_area, Material=ColourSwatch(SwatchColor=RGB(138, 111, 54)))
preview_10 = CustomPreview(Geometry=playground, Material=ColourSwatch(SwatchColor=RGB(99, 72, 13)))
preview_11 = CustomPreview(Geometry=[move_6.Geometry, classroom], Material=ColourSwatch(SwatchColor=RGB(14, 46, 69)))
preview_12 = CustomPreview(Geometry=[move_5.Geometry, stairs], Material=ColourSwatch(SwatchColor=RGB(0, 0, 0)))

# ---- group: CLASSROOMS
X_4 = UnitX(Factor=1)
panel = Panel("0 To 8")
panel_2 = Panel("0 To 6")
panel_3 = Panel("0 To 8")
X_5 = UnitX(Factor=1)
panel_4 = Panel("0 To 8")
panel_5 = Panel("0 To 8")
panel_6 = Panel("0 To 6")
panel_7 = Panel("0 To 6")
panel_8 = Panel("0 To 6")

# ---- group: CLASSROOMS / Split surfaces
srf_4 = Surface(graft(classroom))
in_case_of_doubles_4 = InCaseOfDoubles(B=srf_4, U=panel_2, D=X_4, V=panel, B_2=Slider(8, range=0..10))

srf_5 = Surface(graft(classroom))
Y_2 = UnitY(Factor=1)
in_case_of_doubles_5 = InCaseOfDoubles(B=srf_5, U=panel_4, D=Y_2, V=panel_8, B_2=Slider(8, range=0..10))

srf_6 = Surface(graft(move_6.Geometry))
Y_3 = UnitY(Factor=1)
in_case_of_doubles_6 = InCaseOfDoubles(B=srf_6, U=panel_3, D=Y_3, V=panel_6, B_2=Slider(8, range=0..10))

srf_7 = Surface(graft(move_6.Geometry))
in_case_of_doubles_7 = InCaseOfDoubles(B=srf_7, U=panel_7, D=X_5, V=panel_5, B_2=Slider(8, range=0..10))

# ---- group: ADMINISTRATION
Y_4 = UnitY(Factor=1)
panel_9 = Panel("0 To 8")
panel_10 = Panel("0 To 4")

# ---- group: ADMINISTRATION / Split surfaces
srf_8 = Surface(graft(administration))
in_case_of_doubles_8 = InCaseOfDoubles(B=srf_8, U=panel_9, D=Y_4, V=panel_10, B_2=Slider(8, range=0..10))

# ---- group: WC
Y_5 = UnitY(Factor=1)
panel_11 = Panel("0 To 4")
panel_12 = Panel("0 To 6")
panel_13 = Panel("0 To 6")
Y_6 = UnitY(Factor=1)
panel_14 = Panel("0 To 4")

# ---- group: WC / Split surfaces
srf_9 = Surface(graft(wc))
in_case_of_doubles_9 = InCaseOfDoubles(B=srf_9, U=panel_11, D=Y_5, V=panel_12, B_2=Slider(8, range=0..10))

srf_10 = Surface(graft(move_2.Geometry))
in_case_of_doubles_10 = InCaseOfDoubles(B=srf_10, U=panel_14, D=Y_6, V=panel_13, B_2=Slider(7, range=0..10))

# ----
srf_11 = Surface(corridor)
_4_2_inner_frame = Mesh(<mesh referenced from the Rhino model>)
pt = Point(<point referenced from the Rhino model>)
Y_7 = UnitY(Factor=1)
X_6 = UnitX(Factor=1)
edgesdir = EdgesFromDirections(Brep=srf_11, Directions=Y_7, Reflex=True, Angle=0)  # -> Edges, Indices, Map
edgesdir_2 = EdgesFromDirections(Brep=srf_11, Directions=X_6, Reflex=True, Angle=0)  # -> Edges, Indices, Map
join = JoinCurves(Curves=edgesdir_2.Edges, Preserve=False)  # -> flatten(Curves)
join_2 = JoinCurves(Curves=edgesdir.Edges, Preserve=False)  # -> flatten(Curves)
simplify = SimplifyCurve(Curve=join)  # -> Curve, Simplified
simplify_2 = SimplifyCurve(Curve=join_2)  # -> Curve, Simplified
item_2 = ListItem(List=simplify.Curve, Index=Slider(7, range=0..10), Wrap=True)
item_3 = ListItem(List=simplify.Curve, Index=Slider(5, range=0..10), Wrap=True)
item_4 = ListItem(List=simplify.Curve, Index=Slider(3, range=0..10), Wrap=True)
item_5 = ListItem(List=simplify_2.Curve, Index=Slider(2, range=0..10), Wrap=True)
item_6 = ListItem(List=simplify_2.Curve, Index=Slider(8, range=0..10), Wrap=True)
X_7 = UnitX(Factor=Slider(4, range=0..10))
end = EndPoints(Curve=item_4)  # -> Start, End
X_8 = UnitX(Factor=Slider(4, range=0..10))
end_2 = EndPoints(Curve=[item_2, item_3])  # -> Start, End
arrlinear = LinearArray(Geometry=end.End, Direction=X_7, Count=Slider(3, range=0..10))  # -> Geometry, Transform
Y_8 = UnitY(Factor=Slider(4, range=0..10))
end_3 = EndPoints(Curve=[item_5, item_6])  # -> Start, End
arrlinear_2 = LinearArray(Geometry=end_2.End, Direction=X_8, Count=Slider(4, range=0..10))  # -> Geometry, Transform
arrlinear_3 = LinearArray(Geometry=end_3.End, Direction=Y_8, Count=Slider(4, range=0..10))  # -> Geometry, Transform
pt_2 = Point([arrlinear_2.Geometry, arrlinear.Geometry])
pt_3 = Point(arrlinear_3.Geometry)
vec2pt = Vector2Pt(PointA=pt, PointB=pt_2, Unitize=False)  # -> Vector, Length
vec2pt_2 = Vector2Pt(PointA=pt, PointB=pt_3, Unitize=False)  # -> Vector, Length
_8_6_inner_frame = Mesh(<mesh referenced from the Rhino model>)
_8_6_outer_frame = Mesh(<mesh referenced from the Rhino model>)
_8_8_inner_frame = Mesh(<mesh referenced from the Rhino model>)
_6_4_outer_frame = Mesh(<mesh referenced from the Rhino model>)
_8_4_outer_frame = Mesh(<mesh referenced from the Rhino model>)
_6_4_inner_frame = Mesh(<mesh referenced from the Rhino model>)
move_7 = Move(Geometry=_4_2_inner_frame, Motion=vec2pt.Vector)  # -> Geometry, Transform
move_8 = Move(Geometry=_4_2_inner_frame, Motion=vec2pt_2.Vector)  # -> Geometry, Transform
num = Number(3.141592654)
num_2 = Number(4.71238898)
number_slider_2 = Slider(8, range=0..10)
rotate = Rotate(Geometry=move_7.Geometry, Angle=num, Plane=pt_2)  # -> Geometry, Transform
rotate_2 = Rotate(Geometry=move_8.Geometry, Angle=num_2, Plane=pt_3)  # -> Geometry, Transform
pt_4 = Point(<point referenced from the Rhino model>)
pt_5 = Point(<point referenced from the Rhino model>)
pt_6 = Point(<point referenced from the Rhino model>)
pt_7 = Point(<point referenced from the Rhino model>)
pt_8 = Point(<point referenced from the Rhino model>)
pt_9 = Point(<point referenced from the Rhino model>)
assign_geometries = AssignGeometries(
    G=_6_4_inner_frame,
    G_2=_6_4_inner_frame,
    A_2=pt_6,
    srf=[wc, in_case_of_doubles_9, in_case_of_doubles_2],
    A=pt_6,
    B=Slider(5, range=0..10))  # -> G_3, G_4
assign_geometries_2 = AssignGeometries(
    G=_8_8_inner_frame,
    G_2=_8_8_inner_frame,
    A_2=pt_7,
    srf=[sitting_area, playground, kitchen, first_aid],
    A=pt_7,
    B=Slider(8, range=0..10))  # -> G_3, G_4
assign_geometries_3 = AssignGeometries(
    G=_8_6_inner_frame,
    G_2=_8_6_inner_frame,
    A_2=pt_5,
    srf=[classroom, in_case_of_doubles_5, in_case_of_doubles_4],
    A=pt_5,
    B=number_slider_2)  # -> G_3, G_4
assign_geometries_4 = AssignGeometries(
    G=_6_4_outer_frame,
    G_2=_6_4_outer_frame,
    A_2=pt_9,
    srf=[move_2.Geometry, in_case_of_doubles_10, in_case_of_doubles_3],
    A=pt_9,
    B=Slider(5, range=0..10))  # -> G_3, G_4
assign_geometries_5 = AssignGeometries(
    G=_8_6_outer_frame,
    G_2=_8_6_outer_frame,
    A_2=pt_4,
    srf=[move_6.Geometry, in_case_of_doubles_6, in_case_of_doubles_7],
    A=pt_4,
    B=number_slider_2)  # -> G_3, G_4
assign_geometries_6 = AssignGeometries(
    G=_8_4_outer_frame,
    G_2=_8_4_outer_frame,
    A_2=pt_8,
    srf=[changing_rooms_canteen, in_case_of_doubles_8, in_case_of_doubles, administration],
    A=pt_8,
    B=Slider(5, range=0..10))  # -> G_3, G_4
relay = Relay([assign_geometries_5.G_3, assign_geometries_3.G_3, assign_geometries_3.G_4, assign_geometries_5.G_4, assign_geometries_4.G_3, assign_geometries_4.G_4, assign_geometries.G_3, assign_geometries.G_4, assign_geometries_6.G_3, assign_geometries_6.G_4, assign_geometries_2.G_3, assign_geometries_2.G_4, rotate.Geometry, rotate_2.Geometry])
previewmat = CustomPreviewMaterials(Geometry=relay, DiffuseColor=ColourSwatch(SwatchColor=RGB(150, 101, 66)))

version1_2 = FilePath("C:\Users\Mariana\[ Mariana ]\[ TUDelft ]\[ 5th Quarter ]\EARTHY& SWAT\01 Configuring\PYTHON\export_ALL_v1.csv")
version3_2 = FilePath("C:\Users\Mariana\[ Mariana ]\[ TUDelft ]\[ 5th Quarter ]\EARTHY& SWAT\01 Configuring\PYTHON\export_ALL_v3.csv")
version4_2 = FilePath("C:\Users\Mariana\[ Mariana ]\[ TUDelft ]\[ 5th Quarter ]\EARTHY& SWAT\01 Configuring\PYTHON\export_ALL_v4.csv")
version2_2 = FilePath("C:\Users\Mariana\[ Mariana ]\[ TUDelft ]\[ 5th Quarter ]\EARTHY& SWAT\01 Configuring\PYTHON\export_ALL_v2.csv")
version5_2 = FilePath("C:\Users\Mariana\[ Mariana ]\[ TUDelft ]\[ 5th Quarter ]\EARTHY& SWAT\01 Configuring\PYTHON\export_ALL_v5.csv")
version6_2 = FilePath("C:\Users\Mariana\[ Mariana ]\[ TUDelft ]\[ 5th Quarter ]\EARTHY& SWAT\01 Configuring\PYTHON\export_ALL_v6.csv")
version7_2 = FilePath("C:\Users\Mariana\[ Mariana ]\[ TUDelft ]\[ 5th Quarter ]\EARTHY& SWAT\01 Configuring\PYTHON\export_ALL_v7.csv")
version8_2 = FilePath("C:\Users\Mariana\[ Mariana ]\[ TUDelft ]\[ 5th Quarter ]\EARTHY& SWAT\01 Configuring\PYTHON\export_ALL_v8.csv")

variations_2 = Slider(7, range=1..10)

number_slider_3 = Slider(1, range=0..1)
rectangle_2 = Rectangle(Plane=PlaneXY(0, 0, 0), XSize=number_slider_3, YSize=number_slider_3, Radius=0)  # -> Rectangle, Length
arrrec_2 = RectangularArray(
    Geometry=rectangle_2.Rectangle,
    Cell=rectangle_2.Rectangle,
    XCount=Slider(98, range=0..100),
    YCount=Slider(-35, range=-84..100))  # -> reverse(Geometry), Transform
Y_9 = UnitY(Factor=Slider(81, range=0..100))
X_9 = UnitX(Factor=Slider(6, range=-6..100))
move_9 = Move(Geometry=arrrec_2.Geometry, Motion=Y_9)  # -> Geometry, Transform
move_10 = Move(Geometry=move_9.Geometry, Motion=X_9)  # -> Geometry, Transform
boundary_2 = BoundarySurfaces(Edges=move_10.Geometry)

# ---- group: Import CSV
item_7 = ListItem(
    List=[version1_2, version2_2, version3_2, version4_2, version5_2, version6_2, version7_2, version8_2],
    Index=variations_2,
    Wrap=True)
file_2 = ReadFile(File=item_7, PerLineParse=True)
csv_2 = ReadCSV(CSVString=file_2, Delimiter=",")  # -> Headers, flatten(Values)

# ---- group: FUNCTIONS
courtyard_2 = Courtyard(L=boundary_2, S=csv_2.Values, M=["12", "1"])
corridor_3 = Courtyard(L=boundary_2, S=csv_2.Values, M=["2", "8"])
joker_2 = Courtyard(L=boundary_2, S=csv_2.Values, M="3")
wc_2 = Courtyard(L=boundary_2, S=csv_2.Values, M="4")
first_aid_2 = Courtyard(L=boundary_2, S=csv_2.Values, M="5")
kitchen_2 = Courtyard(L=boundary_2, S=csv_2.Values, M="6")
changing_rooms_canteen_2 = Courtyard(L=boundary_2, S=csv_2.Values, M="7")
administration_2 = Courtyard(L=boundary_2, S=csv_2.Values, M="9")
sitting_area_2 = Courtyard(L=boundary_2, S=csv_2.Values, M="10")
playground_2 = Courtyard(L=boundary_2, S=csv_2.Values, M="11")
classroom_2 = Courtyard(L=boundary_2, S=csv_2.Values, M=["14", "15"])
stairs_2 = Courtyard(L=boundary_2, S=csv_2.Values, M="16")

# ----
corridor_4 = Courtyard(L=boundary_2, S=csv_2.Values, M="13")

# ---- group: PLOT Configuration
preview_13 = CustomPreview(Geometry=courtyard_2, Material=ColourSwatch(SwatchColor=RGB(135, 101, 27)))
preview_14 = CustomPreview(Geometry=[corridor_3, corridor_4], Material=ColourSwatch(SwatchColor=RGB(20, 79, 9)))
preview_15 = CustomPreview(Geometry=joker_2, Material=ColourSwatch(SwatchColor=RGB(42, 65, 235)))
preview_16 = CustomPreview(Geometry=wc_2, Material=ColourSwatch(SwatchColor=RGB(180, 95, 217)))
preview_17 = CustomPreview(Geometry=first_aid_2, Material=ColourSwatch(SwatchColor=RGB(145, 63, 141)))
preview_18 = CustomPreview(Geometry=kitchen_2, Material=ColourSwatch(SwatchColor=RGB(44, 153, 139)))
preview_19 = CustomPreview(Geometry=changing_rooms_canteen_2, Material=ColourSwatch(SwatchColor=RGB(120, 62, 62)))
preview_20 = CustomPreview(Geometry=administration_2, Material=ColourSwatch(SwatchColor=RGB(158, 142, 22)))
preview_21 = CustomPreview(Geometry=sitting_area_2, Material=ColourSwatch(SwatchColor=RGB(138, 111, 54)))
preview_22 = CustomPreview(Geometry=playground_2, Material=ColourSwatch(SwatchColor=RGB(99, 72, 13)))
preview_23 = CustomPreview(Geometry=classroom_2, Material=ColourSwatch(SwatchColor=RGB(14, 46, 69)))
preview_24 = CustomPreview(Geometry=stairs_2, Material=ColourSwatch(SwatchColor=RGB(0, 0, 0)))

# ==== cluster Courtyard
S = ClusterInput()
M = ClusterInput()
mindex = MemberIndex(Set=S, Member=M)  # -> Index, Count
L = ClusterInput()
item = ListItem(List=L, Index=mindex.Index, Wrap=True)
join = BrepJoin(Breps=item)  # -> Breps, Closed
rotate = Rotate(Geometry=join.Breps, Angle=3.141592654, Plane=PlaneXY(0, 0, 0))  # -> Geometry, Transform
G = ClusterOutput(rotate.Geometry)

# ==== cluster AssignGeometries
srf = ClusterInput()
srf_2 = Surface(srf)
X = UnitX(Factor=1)
B = ClusterInput()
edgesdir = EdgesFromDirections(Brep=srf_2, Directions=X, Reflex=True, Angle=0)  # -> Edges, Indices, Map
larger = LargerThan(FirstNumber=edgesdir.Edges, SecondNumber=B)  # -> LargerThan, OrEqualTo
smaller = SmallerThan(FirstNumber=edgesdir.Edges, SecondNumber=B)  # -> SmallerThan, OrEqualTo
cull = CullPattern(List=edgesdir.Edges, CullPattern=smaller.SmallerThan)
cull_2 = CullPattern(List=edgesdir.Edges, CullPattern=larger.OrEqualTo)
item = ListItem(List=cull_2, Index="2", Wrap=True)
item_2 = ListItem(List=cull, Index="2", Wrap=True)
end = EndPoints(Curve=item)  # -> Start, End
end_2 = EndPoints(Curve=item_2)  # -> Start, End
pt = Point(end.End)
pt_2 = Point(end_2.Start)
A = ClusterInput()
A_2 = ClusterInput()
vec2pt = Vector2Pt(PointA=A, PointB=pt_2, Unitize=False)  # -> Vector, Length
vec2pt_2 = Vector2Pt(PointA=A_2, PointB=pt, Unitize=False)  # -> Vector, Length
G = ClusterInput()
G_2 = ClusterInput()
move = Move(Geometry=G, Motion=vec2pt_2.Vector)  # -> Geometry, Transform
move_2 = Move(Geometry=G_2, Motion=vec2pt.Vector)  # -> Geometry, Transform
G_3 = ClusterOutput(move.Geometry)
num = Number(4.71238898)
rotate = Rotate(Geometry=move_2.Geometry, Angle=num, Plane=pt_2)  # -> Geometry, Transform
G_4 = ClusterOutput(rotate.Geometry)

# ==== cluster InCaseOfDoubles
B = ClusterInput()
D = ClusterInput()
edgesdir = EdgesFromDirections(Brep=B, Directions=D, Reflex=True, Angle=0)  # -> Edges, Indices, Map
item = ListItem(List=edgesdir.Edges, Index=0, Wrap=True)
len = Length(Curve=item)
B_2 = ClusterInput()
larger = LargerThan(FirstNumber=len, SecondNumber=B_2)  # -> LargerThan, OrEqualTo
U = ClusterInput()
V = ClusterInput()
cull = CullPattern(List=B, CullPattern=larger.LargerThan)
dom² = ConstructDomain²(DomainU=U, DomainV=V)
subsrf = Isotrim(Surface=cull, Domain=dom²)
S = ClusterOutput(subsrf)
