# Grasshopper definition Form finding with Karamba first check.gh (Grasshopper 1.0.7)
# plug-ins: Kangaroo2 Components, Weaverbird, karambaGH

# ---- group: Insert flat mesh
mesh = Mesh()

# ----
number_slider = Slider(0, range=0..100)
number_slider_2 = Slider(2, range=0..10)
weaverbird_s_constant_quads_split_subdiv = WeaverbirdsConstantQuadsSplitSubdivision(MeshCurves=mesh, Level=number_slider_2, SmoothNakedEdges=[Slider(1, range=0..100), number_slider])
weaverbird_s_catmull_clark_subdivision = WeaverbirdsCatmullClarkSubdivision(MeshCurves=mesh, Level=number_slider_2, SmoothNakedEdges=number_slider)
weaverbird_s_loop_subdivision = WeaverbirdsLoopSubdivision(MeshCurves=mesh, Level=number_slider_2, SmoothNakedEdges=number_slider)
weaverbird_s_split_triangles_subdivision = WeaverbirdsSplitTrianglesSubdivision(MeshCurves=mesh, Level=Slider(5, range=0..10))
mesh_2 = Mesh(weaverbird_s_split_triangles_subdivision)
nakedvertices = NakedVertices(Mesh=mesh_2)  # -> ClothedIndex, NakedIndex, ClothedPts, NakedPts

# ---- group: Anchor points
curve = Curve([<curve referenced from the Rhino model> x6])
curve_2 = Curve([<curve referenced from the Rhino model> x7])
curve_3 = Curve([<curve referenced from the Rhino model> x10])

# ----
point = Point(nakedvertices.NakedPts)
point_in_curve = PointInCurve(Point=point, Curve=graft(curve))  # -> Relationship, Point
point_in_curve_2 = PointInCurve(Point=point, Curve=graft(curve_2))  # -> Relationship, Point
point_in_curve_3 = PointInCurve(Point=point, Curve=graft(curve_3))  # -> Relationship, Point
edgelengths = EdgeLengths(Mesh=mesh_2, LengthFactor=Slider(0.5, range=0..2), Strength=Slider(290, range=0..1000))
vertexloads = VertexLoads(Mesh=mesh_2, Strength=Slider(1, range=0..100))
show = Show(G=mesh_2)
cull_pattern = CullPattern(List=point_in_curve_3.Point, CullPattern=point_in_curve_3.Relationship)
number_slider_3 = Slider(100000, range=0..100000)
cull_pattern_2 = CullPattern(List=point_in_curve_2.Point, CullPattern=point_in_curve_2.Relationship)
cull_pattern_3 = CullPattern(List=point_in_curve.Point, CullPattern=point_in_curve.Relationship)
point_2 = Point(flatten(cull_pattern_3))
point_3 = Point(flatten(cull_pattern_2))
point_4 = Point(flatten(cull_pattern))
anchorxyz = AnchorXYZ(Point=point_4, X=False, Y=Toggle(True), Z=False, Strength=number_slider_3)
anchor = Anchor(Point=point_2, Strength=100000)
anchorxyz_2 = AnchorXYZ(Point=point_3, X=Toggle(True), Y=False, Z=False, Strength=number_slider_3)
solver = Solver(
    GoalObjects=[edgelengths, show, anchor, vertexloads, anchorxyz_2, anchorxyz],
    Reset=Toggle(False),
    Threshold=1e-15,
    Tolerance=0.01,
    On=True)  # -> I, V, O
clean_tree = CleanTree(RemoveNulls=True, RemoveInvalid=True, RemoveEmpty=False, Tree=solver.O)

# ---- group: Final Geometry
list_item = ListItem(List=flatten(clean_tree), Index=0, Wrap=True)

# ----
data_dam = DataDam(DataDataA=list_item, BufferDelay=10000000, BufferMode=0)

# ---- group: First check of stress performance
young_s_modulus_n_mm2 = Panel("150")
yield_strenght_kn_cm2 = Panel("0.13")
specific_weight_kg_m3 = Panel("1500")
mesh_3 = Mesh(data_dam)
expression = Expression(E=young_s_modulus_n_mm2, Expression="E*1000000")
nakedvertices_2 = NakedVertices(Mesh=mesh_3)  # -> ClothedIndex, NakedIndex, ClothedPts, NakedPts
expression_2 = Expression(E=expression, Expression="E*0.0000001")
expression_3 = Expression(d=specific_weight_kg_m3, Expression="d*0.01")
deconstruct = Deconstruct(Point=nakedvertices_2.NakedPts)  # -> XComponent, YComponent, ZComponent
subtraction = Subtraction(A=Slider(0.1, range=0..0.1), B=Slider(1, range=0..1))
panel = Panel(expression_2)
panel_2 = Panel(expression_3)
larger_than = LargerThan(FirstNumber=subtraction, SecondNumber=deconstruct.ZComponent)  # -> LargerThan, OrEqualTo
sort_list = SortList(Keys=deconstruct.ZComponent, ValuesValuesA=deconstruct.ZComponent)  # -> Keys, ValuesValuesA
material_properties_karamba3d = MaterialPropertiesKaramba3D(
    FamilyOfMaterial="Steel",
    Name="S235",
    YoungsModulus_kN_cm2=panel,
    InPlaneShearModulus_kN_cm2=expr("x/2.5", panel),
    TransverseShearModulus_kN_cm2=8076,
    SpecificWeight_kN_m3=panel_2,
    CoefficientOfThermalExpansion_1_C=1e-05,
    YieldStrength_kN_cm2=yield_strenght_kn_cm2,
    mode="Isotrop")
cull_pattern_4 = CullPattern(List=nakedvertices_2.NakedPts, CullPattern=larger_than.LargerThan)
Z = UnitZ(Factor="-10")
point_5 = Point(simplify(flatten(cull_pattern_4)))
supp = SupportKaramba3D(PosInd=point_5, menu=[buttons(on, on, on, off, off, off)])
cross_section = CrossSectionKaramba3D(
    FamilyNameOfCrossSection="DefaultCroSec",
    ElementIdentifier="shell01",
    Material=material_properties_karamba3d,
    Height_cm=Slider(25, range=0..100),
    mode="Shell - Const")
loads = LoadsKaramba3D(Vector=Z, LCase="0", mode="Gravity")
item = ListItem(List=cross_section, Index=0, Wrap=True)
meshtoshell = MeshToShellKaramba3D(Mesh=mesh_3, Identifier="shell01", CrossSection=item, LimitDistance_m=0.005)  # -> Element, Points, Info
assemble = AssembleModelKaramba3D(Elem=meshtoshell.Element, Support=supp, Load=loads, Material=material_properties_karamba3d, LimitDistance_m=0.005)  # -> Model, Info, Mass_kg, CenterOfGravity
analyze = AnalyzeKaramba3D(Model=assemble.Model)  # -> CalculatedModel, MaximumDisplacement_cm, ResultingForceOfGravity_kN, ElasticEnergy_kNm
modelview = ModelViewKaramba3D(Model=analyze.CalculatedModel, ResultFactors=1, ResultCase=-1)  # -> Model, DeformedMesh, DeformedAxes, DeformedModel
shellview = ShellViewKaramba3D(Model=modelview.Model, IndexOfLayer=0)  # -> Model, MeshesOfRenderedShells, LegendColors, flatten(LegendTags)
multiplication = Multiplication(A=shellview.LegendTags, B=Slider(10, range=0..10))
merge = Merge(Data1="stress [N/mm2]", Data2=multiplication)  # -> flatten(Result)
legend = Legend(Colour=shellview.LegendColors, Tags=merge, LegendType=1)
