# Grasshopper definition Voxel Configuration.gh (Grasshopper 1.0.7)
# plug-ins: Bifocals, LunchBox

# ---- group: First Grid
# EARTHY 2021
# 
# Group 8:
# CLOUD MATRIX
# 
# Authors:
# Anna Maria Koniari | Dimitrios Ntoupas | Kwan-Lin Wang | Mariana Georgoulopoulou | Vasilka Espinosa
number_slider = Slider(1, range=0..1)
number_slider_2 = Slider(98, range=0..100)
number_slider_3 = Slider(-41, range=-84..100)
rectangle = Rectangle(Plane=PlaneXY(0, 0, 0), XSize=number_slider, YSize=number_slider, Radius=0)  # -> Rectangle, Length
arrrec = RectangularArray(Geometry=rectangle.Rectangle, Cell=rectangle.Rectangle, XCount=number_slider_2, YCount=number_slider_3)  # -> Geometry, Transform
Y = UnitY(Factor=Slider(35, range=0..100))
move = Move(Geometry=arrrec.Geometry, Motion=Y)  # -> Geometry, Transform
boundary = BoundarySurfaces(Edges=move.Geometry)

# ----
ground_floor = FilePath("C:\Users\Mariana\[ Mariana ]\[ TUDelft ]\[ 5th Quarter ]\EARTHY& SWAT\01 Configuring\PYTHON\Voxel_Configuration\export_ALL_ground floor.csv")

_1st_floor = FilePath("C:\Users\Mariana\[ Mariana ]\[ TUDelft ]\[ 5th Quarter ]\EARTHY& SWAT\01 Configuring\PYTHON\Voxel_Configuration\export_ALL_1st floor.csv")

height_per_floor = Slider(4, range=0..10)

# ---- group: Import CSV
file = ReadFile(File=ground_floor, PerLineParse=True)
csv = ReadCSV(CSVString=file, Delimiter=",")  # -> Headers, flatten(Values)

file_2 = ReadFile(File=_1st_floor, PerLineParse=True)
csv_2 = ReadCSV(CSVString=file_2, Delimiter=",")  # -> Headers, flatten(Values)

# ----
corridor = Courtyard(L=boundary, S=csv_2.Values, M="13")  # -> graft(G)
wc = Courtyard(L=boundary, S=csv_2.Values, M="4")
stairs = Courtyard(L=boundary, S=csv_2.Values, M="16")  # -> graft(G)
administration = Courtyard(L=boundary, S=csv_2.Values, M="9")
sitting_area = Courtyard(L=boundary, S=csv_2.Values, M="10")
classroom = Courtyard(L=boundary, S=csv_2.Values, M=["14", "15"])

# ---- group: FUNCTIONS
courtyard = Courtyard(L=boundary, S=csv.Values, M=["12", "1"])
corridor_2 = Courtyard(L=boundary, S=csv.Values, M=["2", "8", "13"])
joker = Courtyard(L=boundary, S=csv.Values, M="3")
wc_2 = Courtyard(L=boundary, S=csv.Values, M="4")
first_aid = Courtyard(L=boundary, S=csv.Values, M="5")
kitchen = Courtyard(L=boundary, S=csv.Values, M="6")
changing_rooms_canteen = Courtyard(L=boundary, S=csv.Values, M="7")
sitting_area_2 = Courtyard(L=boundary, S=csv.Values, M="10")
playground = Courtyard(L=boundary, S=csv.Values, M="11")
classroom_2 = Courtyard(L=boundary, S=csv.Values, M=["14", "15"])
stairs_2 = Courtyard(L=boundary, S=csv.Values, M="16")  # -> graft(G)
administration_2 = Courtyard(L=boundary, S=csv.Values, M="9")

# ---- group: Second floor
Z = UnitZ(Factor=height_per_floor)
move_2 = Move(Geometry=corridor, Motion=Z)  # -> Geometry, Transform

smaller = SmallerThan(FirstNumber=wc, SecondNumber="32")  # -> SmallerThan, OrEqualTo
cull = CullPattern(List=wc, CullPattern=smaller.SmallerThan)
Z_2 = UnitZ(Factor=height_per_floor)
move_3 = Move(Geometry=cull, Motion=Z_2)  # -> Geometry, Transform

Z_3 = UnitZ(Factor=height_per_floor)
move_4 = Move(Geometry=sitting_area, Motion=Z_3)  # -> Geometry, Transform

Z_4 = UnitZ(Factor=height_per_floor)
move_5 = Move(Geometry=administration, Motion=Z_4)  # -> Geometry, Transform

Z_5 = UnitZ(Factor=height_per_floor)
move_6 = Move(Geometry=classroom, Motion=Z_5)  # -> flatten(Geometry), Transform

Z_6 = UnitZ(Factor=height_per_floor)
move_7 = Move(Geometry=stairs, Motion=Z_6)  # -> Geometry, Transform

# ----
series = Series(Start=0, Step=2, Count=height_per_floor)
multiplication = Multiplication(A=2, B=series)

# ---- group: Second floor
Z_7 = UnitZ(Factor=multiplication)
move_8 = Move(Geometry=joker, Motion=Z_7)  # -> Geometry, Transform

# ----
preview = CustomPreview(Geometry=courtyard, Material=ColourSwatch(SwatchColor=RGB(135, 101, 27)))
preview_2 = CustomPreview(Geometry=[move_7.Geometry, stairs_2], Material=ColourSwatch(SwatchColor=RGB(0, 0, 0)))
preview_3 = CustomPreview(Geometry=[corridor_2, move_2.Geometry], Material=ColourSwatch(SwatchColor=RGB(20, 79, 9)))
preview_4 = CustomPreview(Geometry=playground, Material=ColourSwatch(SwatchColor=RGB(99, 72, 13)))

X = UnitX(Factor=1)
srf = Surface(graft(administration_2))
in_case_of_doubles = InCaseOfDoubles(B=srf, U="0 To 4", D=X, V="0 To 8", B_2=Slider(7, range=0..10))

Y_2 = UnitY(Factor=1)

# ---- group: Split surfaces
srf_2 = Surface(graft(administration_2))
in_case_of_doubles_2 = InCaseOfDoubles(B=srf_2, U="0 To 8", D=Y_2, V="0 To 4", B_2=Slider(7, range=0..10))

# ----
X_2 = UnitX(Factor=1)

# ---- group: Split surfaces
srf_3 = Surface(graft([classroom_2, move_6.Geometry]))
in_case_of_doubles_3 = InCaseOfDoubles(B=srf_3, U="0 To 6", D=X_2, V="0 To 8", B_2=Slider(8, range=0..10))

# ---- group: 16*8 unit
index_point = Slider(44, range=0..100)
y = Slider(8, range=0..10)
x = Slider(16, range=0..16)
function_voxelation = FunctionVoxelation(X=x, Y=y, A=x, A_2=y, i=index_point)  # -> M, i_2
pt = Point(function_voxelation.i_2)
mesh = Mesh(function_voxelation.M)

# ---- group: 6*4 unit
index_point_2 = Slider(36, range=0..100)
x_2 = Slider(6, range=0..10)
y_2 = Slider(4, range=0..10)
function_voxelation_2 = FunctionVoxelation(X=x_2, Y=y_2, A=x_2, A_2=y_2, i=index_point_2)  # -> M, i_2
pt_2 = Point(function_voxelation_2.i_2)
mesh_2 = Mesh(function_voxelation_2.M)

# ---- group: 8*4 unit
index_point_3 = Slider(14, range=0..100)
x_3 = Slider(8, range=0..10)
y_3 = Slider(4, range=0..10)
function_voxelation_3 = FunctionVoxelation(X=x_3, Y=y_3, A=x_3, A_2=y_3, i=index_point_3)  # -> M, i_2
pt_3 = Point(function_voxelation_3.i_2)
mesh_3 = Mesh(function_voxelation_3.M)

index_point_4 = Slider(14, range=0..100)
x_4 = Slider(8, range=0..10)
y_4 = Slider(4, range=0..10)
function_voxelation_4 = FunctionVoxelation(X=x_4, Y=y_4, A=x_4, A_2=y_4, i=index_point_4)  # -> M, i_2
pt_4 = Point(function_voxelation_4.i_2)
mesh_4 = Mesh(function_voxelation_4.M)

index_point_5 = Slider(14, range=0..100)
x_5 = Slider(8, range=0..10)
y_5 = Slider(4, range=0..10)
function_voxelation_5 = FunctionVoxelation(X=x_5, Y=y_5, A=x_5, A_2=y_5, i=index_point_5)  # -> M, i_2
pt_5 = Point(function_voxelation_5.i_2)
mesh_5 = Mesh(function_voxelation_5.M)

# ---- group: 8*8 unit
index_point_6 = Slider(24, range=0..100)
x_6 = Slider(8, range=0..10)
y_6 = Slider(8, range=0..10)
function_voxelation_6 = FunctionVoxelation(X=x_6, Y=y_6, A=x_6, A_2=y_6, i=index_point_6)  # -> M, i_2
pt_6 = Point(function_voxelation_6.i_2)
mesh_6 = Mesh(function_voxelation_6.M)

# ---- group: 8*6 unit
index_point_7 = Slider(19, range=0..100)
x_7 = Slider(8, range=0..10)
y_7 = Slider(6, range=0..10)
function_voxelation_7 = FunctionVoxelation(X=x_7, Y=y_7, A=x_7, A_2=y_7, i=index_point_7)  # -> M, i_2
pt_7 = Point(function_voxelation_7.i_2)
mesh_7 = Mesh(function_voxelation_7.M)

# ----
number_slider_4 = Slider(8, range=0..10)
number_slider_5 = Slider(5, range=0..10)
number_slider_6 = Slider(8, range=0..10)
assign_geometries = AssignGeometries(G=mesh_3, G_2=mesh_3, A_2=pt_3, srf=move_5.Geometry, A=pt_3, B=Slider(10, range=0..10))  # -> G_3, G_4
assign_geometries_2 = AssignGeometries(G=mesh, G_2=mesh, A_2=pt, srf=[joker, move_8.Geometry], A=pt, B=Slider(9, range=0..10))  # -> G_3, G_4
assign_geometries_3 = AssignGeometries(G=mesh_2, G_2=mesh_2, A_2=pt_2, srf=wc_2, A=pt_2, B=number_slider_5)  # -> G_3, G_4
assign_geometries_4 = AssignGeometries(G=mesh_2, G_2=mesh_2, A_2=pt_2, srf=move_3.Geometry, A=pt_2, B=number_slider_5)  # -> G_3, G_4
assign_geometries_5 = AssignGeometries(
    G=mesh_5,
    G_2=mesh_5,
    A_2=pt_5,
    srf=[in_case_of_doubles_2, in_case_of_doubles, administration_2],
    A=pt_5,
    B=Slider(5, range=0..10))  # -> G_3, G_4
assign_geometries_6 = AssignGeometries(G=mesh_7, G_2=mesh_7, A_2=pt_7, srf=[classroom_2, in_case_of_doubles_3], A=pt_7, B=number_slider_6)  # -> flatten(G_3), flatten(G_4)
assign_geometries_7 = AssignGeometries(G=mesh_7, G_2=mesh_7, A_2=pt_7, srf=move_6.Geometry, A=pt_7, B=number_slider_6)  # -> flatten(G_3), flatten(G_4)
assign_geometries_8 = AssignGeometries(G=mesh_4, G_2=mesh_4, A_2=pt_4, srf=changing_rooms_canteen, A=pt_4, B=Slider(5, range=0..10))  # -> G_3, G_4
assign_geometries_9 = AssignGeometries(G=mesh_7, G_2=mesh_7, A_2=pt_7, srf=move_4.Geometry, A=pt_7, B=number_slider_6)  # -> flatten(G_3), flatten(G_4)
assign_geometries_10 = AssignGeometries(G=mesh_6, G_2=mesh_6, A_2=pt_6, srf=sitting_area_2, A=pt_6, B=number_slider_4)  # -> G_3, G_4
assign_geometries_11 = AssignGeometries(G=mesh_6, G_2=mesh_6, A_2=pt_6, srf=kitchen, A=pt_6, B=number_slider_4)  # -> G_3, G_4
assign_geometries_12 = AssignGeometries(G=mesh_6, G_2=mesh_6, A_2=pt_6, srf=first_aid, A=pt_6, B=number_slider_4)  # -> G_3, G_4
preview_5 = CustomPreview(Geometry=[assign_geometries_8.G_3, assign_geometries_8.G_4], Material=ColourSwatch(SwatchColor=RGB(120, 62, 62)))
preview_6 = CustomPreview(
    Geometry=[assign_geometries_5.G_4, assign_geometries_5.G_3, assign_geometries.G_3, assign_geometries.G_4],
    Material=ColourSwatch(SwatchColor=RGB(158, 142, 22)))
preview_7 = CustomPreview(Geometry=[assign_geometries_2.G_3, assign_geometries_2.G_4], Material=ColourSwatch(SwatchColor=RGB(42, 65, 235)))
relay = Relay([assign_geometries_6.G_3, assign_geometries_6.G_4, assign_geometries_7.G_3, assign_geometries_7.G_4])
preview_8 = CustomPreview(Geometry=[assign_geometries_10.G_4, assign_geometries_10.G_3], Material=ColourSwatch(SwatchColor=RGB(138, 111, 54)))
preview_9 = CustomPreview(Geometry=[assign_geometries_11.G_3, assign_geometries_11.G_4], Material=ColourSwatch(SwatchColor=RGB(44, 153, 139)))
preview_10 = CustomPreview(Geometry=[assign_geometries_12.G_3, assign_geometries_12.G_4], Material=ColourSwatch(SwatchColor=RGB(145, 63, 141)))
preview_11 = CustomPreview(Geometry=[assign_geometries_9.G_4, assign_geometries_9.G_3], Material=ColourSwatch(SwatchColor=RGB(138, 111, 54)))

# ---- group: In case of vertical expansion
number_slider_7 = Slider(-100, range=-100..100)  # disabled
number_slider_8 = Slider(0, range=0..100)  # disabled
rectangle_2 = Rectangle(Plane=PlaneXY(0, 0, 0), XSize=number_slider_2, YSize=number_slider_3, Radius=0)  # -> Rectangle, Length; disabled
area = Area(Geometry=[assign_geometries_7.G_3, assign_geometries_7.G_4])  # -> Area, Centroid; disabled
X_3 = UnitX(Factor=number_slider_7)  # disabled
move_9 = Move(Geometry=rectangle_2.Rectangle, Motion=X_3)  # -> Geometry, Transform; disabled
Z_8 = UnitZ(Factor=number_slider_8)  # disabled
move_10 = Move(Geometry=move_9.Geometry, Motion=Z_8)  # -> Geometry, Transform; disabled
number_slider_9 = Slider(1, range=0..10)  # disabled
number_slider_10 = Slider(3, range=0..16)  # disabled
dom = ConstructDomain(DomainStart=number_slider_9, DomainEnd=number_slider_10)  # disabled
number_slider_11 = Slider(1, range=0..1)  # disabled
number_slider_12 = Slider(0, range=0..1)  # disabled
number_slider_13 = Slider(4, range=0..10)  # disabled
geo = Geometry(graft([assign_geometries_7.G_3, assign_geometries_7.G_4]))  # disabled

# ----
point_on_curve = PointOnCurve(move_10.Geometry, parameter=0.254)  # disabled

# ---- group: In case of vertical expansion
area_2 = Area(Geometry=[assign_geometries_4.G_3, assign_geometries_4.G_4])  # -> Area, Centroid; disabled
number_slider_14 = Slider(1, range=0..10)  # disabled
number_slider_15 = Slider(3, range=0..16)  # disabled
dist = Distance(PointA=flatten(area_2.Centroid), PointB=point_on_curve)  # disabled
dom_2 = ConstructDomain(DomainStart=number_slider_14, DomainEnd=number_slider_15)  # disabled
bnd = Bounds(Numbers=dist)  # disabled
remap = RemapNumbers(Value=dist, Source=bnd, Target=dom_2)  # -> Mapped, Clipped; disabled
number_slider_16 = Slider(1, range=0..1)  # disabled
number_slider_17 = Slider(0, range=0..1)  # disabled
integer_division = IntegerDivision(A=remap.Mapped, B=number_slider_16)  # disabled
number_slider_18 = Slider(4, range=0..10)  # disabled
series_2 = Series(Start=number_slider_17, Step=1, Count=integer_division)  # disabled
multiplication_2 = Multiplication(A=series_2, B=number_slider_18)  # disabled
geo_2 = Geometry(graft([assign_geometries_4.G_3, assign_geometries_4.G_4]))  # disabled
Z_9 = UnitZ(Factor=multiplication_2)  # disabled
move_11 = Move(Geometry=geo_2, Motion=Z_9)  # -> Geometry, Transform; disabled

dist_2 = Distance(PointA=flatten(area.Centroid), PointB=point_on_curve)  # disabled
bnd_2 = Bounds(Numbers=dist_2)  # disabled
remap_2 = RemapNumbers(Value=dist_2, Source=bnd_2, Target=dom)  # -> Mapped, Clipped; disabled
integer_division_2 = IntegerDivision(A=remap_2.Mapped, B=number_slider_11)  # disabled
series_3 = Series(Start=number_slider_12, Step=1, Count=integer_division_2)  # disabled
multiplication_3 = Multiplication(A=series_3, B=number_slider_13)  # disabled
Z_10 = UnitZ(Factor=multiplication_3)  # disabled
move_12 = Move(Geometry=geo, Motion=Z_10)  # -> Geometry, Transform; disabled

# ----
preview_12 = CustomPreview(Geometry=[relay, move_12.Geometry], Material=ColourSwatch(SwatchColor=RGB(14, 46, 69)))
preview_13 = CustomPreview(
    Geometry=[assign_geometries_4.G_3, assign_geometries_3.G_4, assign_geometries_3.G_3, assign_geometries_4.G_4, move_11.Geometry],
    Material=ColourSwatch(SwatchColor=RGB(180, 95, 217)))

# ==== cluster Courtyard
S = ClusterInput()
M = ClusterInput()
mindex = MemberIndex(Set=S, Member=M)  # -> Index, Count
L = ClusterInput()
item = ListItem(List=L, Index=mindex.Index, Wrap=True)
join = BrepJoin(Breps=item)  # -> Breps, Closed
rotate = Rotate(Geometry=join.Breps, Angle=3.141592654, Plane=PlaneXY(0, 0, 0))  # -> Geometry, Transform
G = ClusterOutput(rotate.Geometry)

# ==== cluster AssignGeometries
srf = ClusterInput()
srf_2 = Surface(srf)
X = UnitX(Factor=1)
B = ClusterInput()
edgesdir = EdgesFromDirections(Brep=srf_2, Directions=X, Reflex=True, Angle=0)  # -> Edges, Indices, Map
larger = LargerThan(FirstNumber=edgesdir.Edges, SecondNumber=B)  # -> LargerThan, OrEqualTo
smaller = SmallerThan(FirstNumber=edgesdir.Edges, SecondNumber=B)  # -> SmallerThan, OrEqualTo
cull = CullPattern(List=edgesdir.Edges, CullPattern=smaller.SmallerThan)
cull_2 = CullPattern(List=edgesdir.Edges, CullPattern=larger.OrEqualTo)
item = ListItem(List=cull_2, Index="2", Wrap=True)
item_2 = ListItem(List=cull, Index="2", Wrap=True)
end = EndPoints(Curve=item)  # -> Start, End
end_2 = EndPoints(Curve=item_2)  # -> Start, End
pt = Point(end.End)
pt_2 = Point(end_2.Start)
A = ClusterInput()
A_2 = ClusterInput()
vec2pt = Vector2Pt(PointA=A, PointB=pt_2, Unitize=False)  # -> Vector, Length
vec2pt_2 = Vector2Pt(PointA=A_2, PointB=pt, Unitize=False)  # -> Vector, Length
G = ClusterInput()
G_2 = ClusterInput()
move = Move(Geometry=G, Motion=vec2pt_2.Vector)  # -> Geometry, Transform
move_2 = Move(Geometry=G_2, Motion=vec2pt.Vector)  # -> Geometry, Transform
G_3 = ClusterOutput(move.Geometry)
num = Number(4.71238898)
rotate = Rotate(Geometry=move_2.Geometry, Angle=num, Plane=pt_2)  # -> Geometry, Transform
G_4 = ClusterOutput(rotate.Geometry)

# ==== cluster InCaseOfDoubles
B = ClusterInput()
D = ClusterInput()
edgesdir = EdgesFromDirections(Brep=B, Directions=D, Reflex=True, Angle=0)  # -> Edges, Indices, Map
item = ListItem(List=edgesdir.Edges, Index=0, Wrap=True)
len = Length(Curve=item)
B_2 = ClusterInput()
larger = LargerThan(FirstNumber=len, SecondNumber=B_2)  # -> LargerThan, OrEqualTo
U = ClusterInput()
V = ClusterInput()
cull = CullPattern(List=B, CullPattern=larger.LargerThan)
dom² = ConstructDomain²(DomainU=U, DomainV=V)
subsrf = Isotrim(Surface=cull, Domain=dom²)
S = ClusterOutput(subsrf)

# ==== cluster FunctionVoxelation
number_slider = Slider(4, range=0..10)
X = ClusterInput()
Y = ClusterInput()
number_slider_2 = Slider(2, range=0..10)
rectangle = Rectangle(Plane=PlaneXY(0, 0, 0), XSize=X, YSize=Y, Radius=0)  # -> Rectangle, Length
A = ClusterInput()
A_2 = ClusterInput()
boxrec = BoxRectangle(Rectangle=rectangle.Rectangle, Height=number_slider)
division = Division(A=A, B=number_slider_2)
division_2 = Division(A=A_2, B=number_slider_2)
division_3 = Division(A=number_slider, B=number_slider_2)
mbox = MeshBox(Base=boxrec, XCount=division, YCount=division_2, ZCount=division_3)
demesh = DeconstructMesh(Mesh=mbox)  # -> Vertices, Faces, Colours, Normals
M = ClusterOutput(mbox)
i = ClusterInput()
item = ListItem(List=demesh.Vertices, Index=i, Wrap=True)
i_2 = ClusterOutput(item)
