# Grasshopper definition Structural Analysis_Cloud Matrix.gh (Grasshopper 1.0.7)
# plug-ins: Kangaroo2 Components, karambaGH, Pufferfish, MeshEdit Components

negative = Negative(Value=Slider(0.4, range=0..1))

# ----
# Case 5
# 4  x 6  x 5 m
# Toilet and Storage
# Inner Shell
mesh = Mesh(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)

# ----
# Outer Shell
mesh_2 = Mesh(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)

# ----
# Wall with a door
wall_with_door = Curve(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)

offset_mesh = OffsetMesh(Mesh=mesh_2, Distance=negative, BothSides=0, CreateSolid=True)

# ----
# Blind Wall
curve = Curve([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])

# ----
# Perfurated Wall
curve_2 = Curve(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)

nakedvertices = NakedVertices(Mesh=mesh)  # -> ClothedIndex, NakedIndex, ClothedPts, flatten(NakedPts)

# ----
# Blind Wall
point = Point([Point(4, 0.4999923706, -4.494190216e-05), Point(4, 0.492023468, 0.4125061035), Point(4, 0.5125007629, 0.8533627391), Point(4, 0.5590744019, 1.325700283), Point(3.999862671, 0.6436347961, 1.83962059), Point(3.992614746, 1.118483543, 2.436272144), Point(3.991027832, 1.6780653, 2.914225578), Point(3.989395142, 2.301505089, 3.30085516), Point(3.99130249, 2.999991417, 3.582268715), Point(3.989395142, 3.69848156, 3.30085516), Point(3.991027832, 4.321921349, 2.914225578), Point(3.992614746, 4.88149929, 2.436272144), Point(3.999862671, 5.356352806, 1.83962059), Point(4, 5.440909386, 1.325700283), Point(4, 5.487483025, 0.8533627391), Point(4, 5.50796032, 0.4125061035), Point(4, 5.499991417, -4.494190216e-05)])
point_2 = Point([Point(0, 5.499991417, -4.494190216e-05), Point(0, 5.50796032, 0.4125061035), Point(0, 5.487483025, 0.8533626199), Point(0, 5.440909386, 1.325700164), Point(0.0001373291016, 5.356352806, 1.839620352), Point(0.007385253906, 4.88149929, 2.436271906)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])

# ----
# Wall with a door
point_3 = Point([Point(3.75, 5.999991417, -4.589557648e-05), Point(3.755996704, 5.999991417, 0.4086102247), Point(3.741760254, 5.999987602, 0.8451204896), Point(3.698150635, 5.999976158, 1.3084867), Point(3.614562988, 5.999815941, 1.804117322), Point(3.298706055, 5.991522789, 2.284624338)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])

# ----
# Perfurated Wall
point_4 = Point([Point(0.25, -7.629394531e-06, -4.589557648e-05), Point(0.2440032959, -7.629394531e-06, 0.4086102247), Point(0.2582397461, -3.814697266e-06, 0.84512043), Point(0.3018493652, 1.14440918e-05, 1.3084867), Point(0.3854370117, 0.000171661377, 1.804117322), Point(0.7012939453, 0.008460998535, 2.284624338)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])

point_5 = Point(nakedvertices.NakedPts)

# ----
# Create the Wall - Blind
point_in_curves = PointInCurves(Point=nakedvertices.NakedPts, Curves=graft(curve))  # -> Relationship, Index, Point
cull_pattern = CullPattern(List=nakedvertices.NakedPts, CullPattern=point_in_curves.Relationship)
cull_duplicates = CullDuplicates(Points=cull_pattern, Tolerance=0.1, CullMode=3)  # -> Points, Indices, Valence
sort_list = SortList(Keys=cull_duplicates.Points, ValuesValuesA=cull_duplicates.Points)  # -> Keys, ValuesValuesA
polyline = PolyLine(Vertices=sort_list.ValuesValuesA, Closed=False)
end_points = EndPoints(Curve=polyline)  # -> Start, End
line = Line(StartPoint=end_points.Start, EndPoint=end_points.End)
join_curves = JoinCurves(Curves=[polyline, line], Preserve=False)
boundary_surfaces = BoundarySurfaces(Edges=join_curves)

# ----
# Create the Wall - Door
point_in_curve = PointInCurve(Point=nakedvertices.NakedPts, Curve=wall_with_door)  # -> Relationship, Point
cull_pattern_2 = CullPattern(List=nakedvertices.NakedPts, CullPattern=point_in_curve.Relationship)
cull_duplicates_2 = CullDuplicates(Points=cull_pattern_2, Tolerance=0.1, CullMode=3)  # -> Points, Indices, Valence
sort_points = SortPoints(Points=cull_duplicates_2.Points)  # -> Points, Indices
polyline_2 = PolyLine(Vertices=sort_points.Points, Closed=False)
end_points_2 = EndPoints(Curve=polyline_2)  # -> Start, End
line_2 = Line(StartPoint=end_points_2.Start, EndPoint=end_points_2.End)
join_curves_2 = JoinCurves(Curves=[polyline_2, line_2], Preserve=False)
boundary_surfaces_2 = BoundarySurfaces(Edges=join_curves_2)

# ----
# Create the Wall - Perfurated
point_in_curve_2 = PointInCurve(Point=nakedvertices.NakedPts, Curve=curve_2)  # -> Relationship, Point
cull_pattern_3 = CullPattern(List=nakedvertices.NakedPts, CullPattern=point_in_curve_2.Relationship)
cull_duplicates_3 = CullDuplicates(Points=cull_pattern_3, Tolerance=0.1, CullMode=3)  # -> Points, Indices, Valence
sort_points_2 = SortPoints(Points=cull_duplicates_3.Points)  # -> Points, Indices
polyline_3 = PolyLine(Vertices=sort_points_2.Points, Closed=False)
end_points_3 = EndPoints(Curve=polyline_3)  # -> Start, End
line_3 = Line(StartPoint=end_points_3.Start, EndPoint=end_points_3.End)
join_curves_3 = JoinCurves(Curves=[line_3, polyline_3], Preserve=False)
boundary_surfaces_3 = BoundarySurfaces(Edges=join_curves_3)

# ----
# Create the Wall - Perfurated
polyline_4 = PolyLine(Vertices=point_4, Closed=False)
end_points_4 = EndPoints(Curve=polyline_4)  # -> Start, End
line_4 = Line(StartPoint=end_points_4.Start, EndPoint=end_points_4.End)
join_curves_4 = JoinCurves(Curves=[line_4, polyline_4], Preserve=False)
boundary_surfaces_4 = BoundarySurfaces(Edges=join_curves_4)

# ----
# Create the Wall - Door
polyline_5 = PolyLine(Vertices=point_3, Closed=False)
end_points_5 = EndPoints(Curve=polyline_5)  # -> Start, End
line_5 = Line(StartPoint=end_points_5.Start, EndPoint=end_points_5.End)
join_curves_5 = JoinCurves(Curves=[polyline_5, line_5], Preserve=False)
boundary_surfaces_5 = BoundarySurfaces(Edges=join_curves_5)

# ----
# Create the Wall - Blind
polyline_6 = PolyLine(Vertices=point_2, Closed=False)
polyline_7 = PolyLine(Vertices=point, Closed=False)
end_points_6 = EndPoints(Curve=polyline_6)  # -> Start, End
end_points_7 = EndPoints(Curve=polyline_7)  # -> Start, End
line_6 = Line(StartPoint=end_points_6.Start, EndPoint=end_points_6.End)
line_7 = Line(StartPoint=end_points_7.Start, EndPoint=end_points_7.End)
join_curves_6 = JoinCurves(Curves=[polyline_6, line_6], Preserve=False)
join_curves_7 = JoinCurves(Curves=[polyline_7, line_7], Preserve=False)
boundary_surfaces_6 = BoundarySurfaces(Edges=join_curves_6)
boundary_surfaces_7 = BoundarySurfaces(Edges=join_curves_7)

# ----
# Slab
point_6 = Point(Point(4, 5.999989986, 0))
construct_point = ConstructPoint(XCoordinate="0", YCoordinate="0", ZCoordinate="0")
flor_height = Slider(5, range=0..10)
rectangle_2pt = Rectangle2Pt(Plane=PlaneXY(0, 0, 0), PointA=construct_point, PointB=point_6, Radius=0)  # -> Rectangle, Length
unit_z = UnitZ(Factor=flor_height)
surface = Surface(rectangle_2pt.Rectangle)
move = Move(Geometry=surface, Motion=unit_z)  # -> Geometry, Transform
deconstruct_brep = DeconstructBrep(Brep=move.Geometry)  # -> Faces, simplify(Edges), Vertices
join_curves_8 = JoinCurves(Curves=deconstruct_brep.Edges, Preserve=False)
trim_tree = TrimTree(Tree=join_curves_8, Depth=1)

# ----
# Columns - Edge
nakedvertices_2 = NakedVertices(Mesh=mesh_2)  # -> ClothedIndex, NakedIndex, ClothedPts, flatten(NakedPts)
deconstruct = Deconstruct(Point=nakedvertices_2.NakedPts)  # -> XComponent, YComponent, ZComponent
smaller_than = SmallerThan(FirstNumber=deconstruct.ZComponent, SecondNumber="0.1")  # -> SmallerThan, OrEqualTo
cull_pattern_4 = CullPattern(List=nakedvertices_2.NakedPts, CullPattern=smaller_than.SmallerThan)
create_set = CreateSet(List=cull_pattern_4)  # -> Set, Map
partition_list = PartitionList(List=create_set.Set, Size=Slider(9, range=0..100))
sort_along_curve = SortAlongCurve(Points=partition_list, Curve=rectangle_2pt.Rectangle)  # -> Points, Indices
explode_tree = ExplodeTree(Data=sort_along_curve.Points)  # -> Branch0, Branch1, Branch2, Branch3
tree_branch = TreeBranch(Tree=sort_along_curve.Points, Path="{0;2;0}", MaintainPaths=True)
list_item = ListItem(List=tree_branch, Index=Slider(3, range=0..9), Wrap=True)
point_sort_items = PointSortItems(Items=tree_branch, Start=list_item, Points=tree_branch)  # -> SortedItems, SortedIndices, SortedPoints
shift_list = ShiftList(List=point_sort_items.SortedPoints, Shift="-1", Wrap=True)
trim_tree_2 = TrimTree(Tree=shift_list, Depth="2")
polyline_8 = PolyLine(Vertices=[explode_tree.Branch0, explode_tree.Branch1, explode_tree.Branch3, trim_tree_2], Closed=False)

surface_2 = Surface(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)
surface_3 = Surface(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)

# ----
# Wall Extruded - outer shell
thickness = Slider(0.25, range=0..1)
unit_x = UnitX(Factor=thickness)
unit_y = UnitY(Factor=thickness)
negative_2 = Negative(Value=unit_y)
negative_3 = Negative(Value=unit_x)
extrude = Extrude(Base=surface_2, Direction=negative_2)
extrude_2 = Extrude(Base=surface_3, Direction=unit_y)
extrude_3 = Extrude(Base=boundary_surfaces_7, Direction=negative_3)
extrude_4 = Extrude(Base=boundary_surfaces_6, Direction=unit_x)

mesh_brep = MeshBrep(
    Brep=flatten([extrude_4, extrude_3]),
    Settings={GridMaxCount=0, GridMinCount=16, JaggedSeams=False, MaxEdgeLength=0, MinEdgeLength=0.0001, MinTolerance=0, Refine=True, RefineAngle=0, RelativeTolerance=0.65, SimplePlanes=True, Tolerance=0})
unit_x_2 = UnitX(Factor=Slider(1.25, range=0.78..1.7))
curve_3 = Curve(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)
move_2 = Move(Geometry=curve_3, Motion=unit_x_2)  # -> Geometry, Transform
surface_4 = Surface(<surface referenced from the Rhino model>)
surface_5 = Surface(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)

# ----
# Wall Extruded - inner shell
explode_tree_2 = ExplodeTree(Data=boundary_surfaces)  # -> _0000, _0100
number_slider = Slider(0.25, range=0..1)
unit_x_3 = UnitX(Factor=number_slider)
unit_y_2 = UnitY(Factor=number_slider)
negative_4 = Negative(Value=unit_y_2)
negative_5 = Negative(Value=unit_x_3)
extrude_5 = Extrude(Base=surface_5, Direction=negative_4)
extrude_6 = Extrude(Base=surface_4, Direction=unit_y_2)
extrude_7 = Extrude(Base=explode_tree_2._0000, Direction=unit_x_3)
extrude_8 = Extrude(Base=explode_tree_2._0100, Direction=negative_5)

mesh_brep_2 = MeshBrep(
    Brep=surface_4,
    Settings={GridMaxCount=0, GridMinCount=16, JaggedSeams=False, MaxEdgeLength=0, MinEdgeLength=0.0001, MinTolerance=0, Refine=True, RefineAngle=0, RelativeTolerance=0.65, SimplePlanes=True, Tolerance=0})
mesh_brep_3 = MeshBrep(
    Brep=surface_5,
    Settings={GridMaxCount=0, GridMinCount=16, JaggedSeams=False, MaxEdgeLength=0, MinEdgeLength=0.0001, MinTolerance=0, Refine=True, RefineAngle=0, RelativeTolerance=0.65, SimplePlanes=True, Tolerance=0})
mesh_brep_4 = MeshBrep(
    Brep=boundary_surfaces,
    Settings={GridMaxCount=0, GridMinCount=16, JaggedSeams=False, MaxEdgeLength=0, MinEdgeLength=0.0001, MinTolerance=0, Refine=True, RefineAngle=0, RelativeTolerance=0.65, SimplePlanes=True, Tolerance=0})

# ---- group: Mesh and blind 4 blind walls
mesh_join = MeshJoin(Meshes=flatten([boundary_surfaces_3, boundary_surfaces_2, boundary_surfaces, mesh]))

# ---- group: Only the Mesh
mesh_join_2 = MeshJoin(Meshes=flatten(mesh))

# ---- group: Ground Floor - Only Walls
mesh_join_3 = MeshJoin(Meshes=flatten([mesh_brep_4, mesh_brep_3, mesh_brep_2]))

# ----
unit_z_2 = UnitZ(Factor=Slider(5, range=0..10))
surface_6 = Surface(trim_tree)
surface_7 = Surface(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)
surface_8 = Surface(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)
mesh_brep_5 = MeshBrep(
    Brep=boundary_surfaces_7,
    Settings={GridMaxCount=0, GridMinCount=16, JaggedSeams=False, MaxEdgeLength=0, MinEdgeLength=0.0001, MinTolerance=0, Refine=True, RefineAngle=0, RelativeTolerance=0.65, SimplePlanes=True, Tolerance=0})
mesh_brep_6 = MeshBrep(
    Brep=boundary_surfaces_6,
    Settings={GridMaxCount=0, GridMinCount=16, JaggedSeams=False, MaxEdgeLength=0, MinEdgeLength=0.0001, MinTolerance=0, Refine=True, RefineAngle=0, RelativeTolerance=0.65, SimplePlanes=True, Tolerance=0})
mesh_brep_7 = MeshBrep(
    Brep=surface_8,
    Settings={GridMaxCount=0, GridMinCount=16, JaggedSeams=False, MaxEdgeLength=0, MinEdgeLength=0.0001, MinTolerance=0, Refine=True, RefineAngle=0, RelativeTolerance=0.65, SimplePlanes=True, Tolerance=0})
mesh_brep_8 = MeshBrep(
    Brep=surface_7,
    Settings={GridMaxCount=0, GridMinCount=16, JaggedSeams=False, MaxEdgeLength=0, MinEdgeLength=0.0001, MinTolerance=0, Refine=True, RefineAngle=0, RelativeTolerance=0.65, SimplePlanes=True, Tolerance=0})
close_mesh = CloseMesh(Mesh=mesh, Quadrangulate=True)  # -> Closed, Amount, Openings, ResultBoolean

# ----
# Upper Floor
number_slider_2 = Slider(5, range=0..100)
unit_z_3 = UnitZ(Factor=number_slider_2)
unit_z_4 = UnitZ(Factor=Slider(5, range=0..10))
mesh_3 = Mesh(mesh_2)
move_3 = Move(Geometry=[mesh_brep_5, mesh_brep_6], Motion=unit_z_3)  # -> Geometry, Transform

# ---- group: Shell - Upper Floor
move_4 = Move(Geometry=mesh_3, Motion=unit_z_4)  # -> Geometry, Transform

# ---- group: Walls - Upper Floor
wall_in_the_upper_floor = MeshJoin(Meshes=flatten([move_3.Geometry, mesh_brep_8, mesh_brep_7]))

# ---- group: Upper Floor
mesh_join_4 = MeshJoin(Meshes=flatten([wall_in_the_upper_floor, move_4.Geometry]))

# ----
# Case 4
# 4 x 8 x 5 m
# Administration, Cantine, Stairs,
# Changing Room, Teacher Room
# and Meeting Room
# Mesh
mesh_4 = Mesh(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)

# ----
# Earthy Filling
# Mesh
mesh_5 = Mesh(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)

# ----
# Roof Mesh
mesh_6 = Mesh(Tree({0;0}: [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], {0;0;0;0;0;0}: [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], {0;0;0;0;0;1}: [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]))

# ----
# All the Structural Cases
# Case 1
# 8 x 16 x 8.5m
# Joker
# Roof Mesh
mesh_7 = Mesh(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)

# ----
# Mesh
mesh_8 = Mesh(Tree({0}: [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], {0;0}: [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], {0;0;0;0;0}: [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], {0;0;0;0;0;0}: [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]))

# ----
# Case 2
# 8 x 8 x 5 m
# Kitchen, First Aid,
# Sitting Area
# Mesh
mesh_join_5 = MeshJoin(Meshes=flatten(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))

# ----
# Roof Mesh
mesh_join_6 = MeshJoin(Meshes=flatten(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))

# ----
# Earthy Filling
# Mesh
mesh_9 = Mesh(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)

# ----
# Case 6
# 2 x 2 x 4m
# Corridor
# Mesh
mesh_join_7 = MeshJoin(Meshes=flatten([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]))

# ----
# Earthy Filling
# Mesh
mesh_10 = Mesh(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)

# ----
# Roof Mesh
mesh_11 = Mesh(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)

# ----
# Earthy Filling
# Mesh
mesh_join_8 = MeshJoin(Meshes=flatten([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]))

# ----
# Case 7
# 4  x 6  x 5 m
# W.C.
# The volume of the filling
# should be multiplied by 5,
#  since in this case we have
#  multiple floors
# Mesh
mesh_join_9 = MeshJoin(Meshes=flatten([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]))

# ----
# Roof Mesh
mesh_12 = Mesh(Tree({0;0}: [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], {0;1}: [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]))

# ----
# Earthy Filling
# Mesh
mesh_13 = Mesh(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)

# ----
# Case 3
# 6 x 8  x 6 m
# Classroom, Sitting Area
# Roof Mesh
mesh_14 = Mesh(flatten(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))

# ----
# Mesh
mesh_15 = Mesh(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)

# ----
# STRUCTURAL ANALYSIS
# This part of the grasshopper script is
#  standard to all the cases. By having
# structural mesh you can just connect
#  to the Karamba Analysis. The only
# difference between the cases are the
# types of loads considered, the floor
# area and the volume
# Brick Material Properties
young_s_modulus_n_mm2 = Panel("150")
yield_strenght_kn_cm2 = Panel("0.13")
specific_weight_kg_m3 = Panel("1500")
expression = Expression(E=young_s_modulus_n_mm2, Expression="E*1000000")
expression_2 = Expression(E=expression, Expression="E*0.0000001")
expression_3 = Expression(d=specific_weight_kg_m3, Expression="d*0.01")
panel = Panel(expression_2)
panel_2 = Panel(expression_3)
material_properties_karamba3d = MaterialPropertiesKaramba3D(
    FamilyOfMaterial="Adobe",
    Name="S235",
    YoungsModulus_kN_cm2=panel,
    InPlaneShearModulus_kN_cm2=expr("x/2.5", panel),
    TransverseShearModulus_kN_cm2=8076,
    SpecificWeight_kN_m3=panel_2,
    CoefficientOfThermalExpansion_1_C=1e-05,
    YieldStrength_kN_cm2=yield_strenght_kn_cm2,
    mode="Isotrop")

# ----
# Regular Floors - solid with walls
mesh_volume = MeshVolume(Mesh=mesh_join_8)  # -> Volume, Centroid
floor_on_top = Panel("5")
number = Number(mesh_volume.Volume)
multiplication = Multiplication(A=number, B=floor_on_top)

# ---- group: SAFETY FACTOR
# Safety Factor
safety_factor = Slider(1.5, range=0..10)

# ----
# Upper Floor
mesh_16 = Mesh(mesh_join_4)

# ----
# Cross Section
cm = Slider(40, range=0..100)
cross_section = CrossSectionKaramba3D(FamilyNameOfCrossSection="DefaultCroSec", Material=material_properties_karamba3d, Height_cm=cm, mode="Shell - Const")

# ---- group: VERTICAL LOADS / LIVE LOAD
# Live Load
live_load_kn_m2 = Slider(4, range=0..10)
# Multiply by Safety Factor
multiplication_2 = Multiplication(A=live_load_kn_m2)
negative_6 = Negative(Value=multiplication_2)
Z = UnitZ(Factor=negative_6)
loads = LoadsKaramba3D(Vector=Z, Mesh=mesh_16, LCase="0", mode="MeshLoad -Const.", menu=[buttons(off, on, off), buttons(on, on)])

# ---- group: WIND LOAD
# Wind Load
wind_load_kn_m2 = Panel("0.2")
# Multiply by Safety Factor
multiplication_3 = Multiplication(A=wind_load_kn_m2)
negative_7 = Negative(Value=multiplication_3)
unit_x_4 = UnitX(Factor=negative_7)
# Depending on the case
# not all the load types will
# be used.
loads_2 = LoadsKaramba3D(Vector=unit_x_4, Mesh=mesh_16, LCase="0", mode="MeshLoad -Const.", menu=[buttons(off, on, off), buttons(on, on)])

# ---- group: GRAVITY
# Gravity
panel_3 = Panel("1")
# Multiply by Safety Factor
multiplication_4 = Multiplication(A=panel_3)
negative_8 = Negative(Value=multiplication_4)
Z_2 = UnitZ(Factor=negative_8)
loads_3 = LoadsKaramba3D(Vector=Z_2, LCase="0", mode="Gravity")

# ----
param_viewer = ParamViewer()

# ----
# GEOMETRY DESIGN
# In this part of the script is specific to
# the case 5 (Toilet and Storage). This
# script is used to:
# - extract the mesh
# - create walls
# - find the volume of the earthy filling
# - find the volume of the roof
# - create the volume
# Columns - Edge
nakedvertices_3 = NakedVertices(Mesh=mesh)  # -> ClothedIndex, NakedIndex, ClothedPts, flatten(NakedPts)
deconstruct_2 = Deconstruct(Point=nakedvertices_3.NakedPts)  # -> XComponent, YComponent, ZComponent
smaller_than_2 = SmallerThan(FirstNumber=deconstruct_2.ZComponent, SecondNumber="0.1")  # -> SmallerThan, OrEqualTo
cull_pattern_5 = CullPattern(List=nakedvertices_3.NakedPts, CullPattern=smaller_than_2.SmallerThan)
create_set_2 = CreateSet(List=cull_pattern_5)  # -> Set, Map
partition_list_2 = PartitionList(List=create_set_2.Set, Size=Slider(9, range=0..100))
sort_along_curve_2 = SortAlongCurve(Points=partition_list_2, Curve=rectangle_2pt.Rectangle)  # -> Points, Indices

list_item_2 = ListItem(List=sort_along_curve_2.Points, Index=0, Wrap=True)
point_sort_items_2 = PointSortItems(Items=partition_list_2, Start=list_item_2, Points=partition_list_2)  # -> SortedItems, SortedIndices, SortedPoints

polyline_9 = PolyLine(Vertices=point_sort_items_2.SortedPoints, Closed=False)

join_curves_9 = JoinCurves(Curves=flatten([polyline_8, polyline_9]), Preserve=False)

# ---- group: COLUMNS
surface_9 = Surface(join_curves_9)
unit_z_5 = UnitZ(Factor=1)
area = Area(Geometry=surface_9)  # -> Area, Centroid
line_sdl = LineSDL(Start=area.Centroid, Direction=unit_z_5, Length=Slider(6.9, range=0..10))

# ----
extrude_9 = Extrude(Base=surface_9, Direction=unit_z_2)
surface_10 = Surface(join_curves_9)
brep_join = BrepJoin(Breps=[surface_6, surface_10])  # -> Breps, Closed
surface_11 = Surface(join_curves_9)
mesh_brep_9 = MeshBrep(
    Brep=surface_11,
    Settings={GridMaxCount=0, GridMinCount=16, JaggedSeams=False, MaxEdgeLength=0, MinEdgeLength=0.0001, MinTolerance=0, Refine=True, RefineAngle=0, RelativeTolerance=0.65, SimplePlanes=True, Tolerance=0})
mesh_brep_10 = MeshBrep(
    Brep=brep_join.Breps,
    Settings={GridMaxCount=0, GridMinCount=16, JaggedSeams=False, MaxEdgeLength=0, MinEdgeLength=0.0001, MinTolerance=0, Refine=True, RefineAngle=0, RelativeTolerance=0.65, SimplePlanes=True, Tolerance=0})
close_mesh_2 = CloseMesh(Mesh=mesh_brep_10, Quadrangulate=True)  # -> Closed, Amount, Openings, ResultBoolean
mesh_join_10 = MeshJoin(Meshes=flatten([close_mesh.Closed, close_mesh_2.Closed]))

# ---- group: Ground Floor Shell and Walls
mesh_join_11 = MeshJoin(Meshes=flatten([mesh, mesh_brep_2, mesh_brep_3, mesh_brep_4, mesh_brep_9]))

# ----
# Filling
mesh_17 = Mesh(mesh_join_10)

# ----
# Self-weight of the Upper Floor
width = Slider(0.4, range=0..1)
negative_9 = Negative(Value=width)
offset_mesh_2 = OffsetMesh(Mesh=mesh_16, Distance=negative_9, BothSides=0, CreateSolid=True)
mesh_join_12 = MeshJoin(Meshes=flatten(offset_mesh_2))
mesh_volume_2 = MeshVolume(Mesh=mesh_join_12)  # -> Volume, Centroid
floor_area_m2 = Slider(24, range=0..100)
density_kg_m3 = Panel("1500")
multiplication_5 = Multiplication(A=mesh_volume_2.Volume, B=density_kg_m3)
division = Division(A=multiplication_5, B=floor_area_m2)
tranform_in_kn = Panel("0.01")
multiplication_6 = Multiplication(A=division, B=tranform_in_kn)
multiplication_7 = Multiplication(A=multiplication_6)
panel_4 = Panel(multiplication_6)  # "kn/m2"
negative_10 = Negative(Value=multiplication_7)
unit_z_6 = UnitZ(Factor=negative_10)
loads_4 = LoadsKaramba3D(Vector=unit_z_6, Mesh=mesh_join_11, LCase="0", mode="MeshLoad -Const.", menu=[buttons(off, on, off), buttons(on, on)])

# ----
# Load of the Sand
density_in_kn_m3 = Panel("15")
thickness_m = Panel("0.05")
multiplication_8 = Multiplication(A=thickness_m, B=density_in_kn_m3)
# Multiply by Safety Factor
safety_factor_2 = Multiplication(A=multiplication_8)
panel_5 = Panel(safety_factor_2)  # "kn/m2"
negative_11 = Negative(Value=safety_factor_2)
unit_z_7 = UnitZ(Factor=negative_11)
loads_5 = LoadsKaramba3D(Vector=unit_z_7, Mesh=mesh_join_11, LCase="0", mode="MeshLoad -Const.", menu=[buttons(off, on, off), buttons(on, on)])

# ----
# Load of the Filling
mesh_volume_3 = MeshVolume(Mesh=mesh_17)  # -> Volume, Centroid
floor_area_m2_2 = Slider(24, range=0..100)
density_kg_m3_2 = Panel("1500")
multiplication_9 = Multiplication(A=mesh_volume_3.Volume, B=density_kg_m3_2)
division_2 = Division(A=multiplication_9, B=floor_area_m2_2)
tranform_in_kn_2 = Panel("0.01")
multiplication_10 = Multiplication(A=division_2, B=tranform_in_kn_2)
panel_6 = Panel(multiplication_10)  # "kn/m2"
multiplication_11 = Multiplication(A=multiplication_10)
negative_12 = Negative(Value=multiplication_11)
panel_7 = Panel(multiplication_11)  # "kn/m2"
unit_z_8 = UnitZ(Factor=negative_12)
loads_6 = LoadsKaramba3D(Vector=unit_z_8, Mesh=mesh_join_11, LCase="0", mode="MeshLoad -Const.", menu=[buttons(off, on, off), buttons(on, on)])

# ----
# Ground Floor - Shell and Walls
panel_8 = Panel("W.C.")
meshtoshell = MeshToShellKaramba3D(Mesh=mesh_join_11, Identifier=panel_8, CrossSection=cross_section, LimitDistance_m=0.005)  # -> Element, Points, Info

point_7 = Point(meshtoshell.Points)

# ----
# Support
number_slider_3 = Slider(0.01, range=0..1)
deconstruct_3 = Deconstruct(Point=meshtoshell.Points)  # -> XComponent, YComponent, ZComponent
smaller_than_3 = SmallerThan(FirstNumber=deconstruct_3.ZComponent, SecondNumber=number_slider_3)  # -> SmallerThan, OrEqualTo
cull_pattern_6 = CullPattern(List=meshtoshell.Points, CullPattern=smaller_than_3.SmallerThan)
panel_9 = Panel("""36
37""")
# Multiply by Safety Factor
cull_index = CullIndex(List=cull_pattern_6, Indices=panel_9, Wrap=True)
supp = SupportKaramba3D(PosInd=cull_index, menu=[buttons(on, on, on, off, off, off)])

# ----
# Columns
cm_2 = Slider(50, range=0..100)
cm_3 = Slider(30, range=0..100)
# Multiply by Safety Factor
number_slider_4 = Slider(5, range=0..10)
cross_section_karamba3d = CrossSectionKaramba3D(
    FamilyNameOfCrossSection="DefaultCroSec",
    Material=material_properties_karamba3d,
    Height_cm=cm_2,
    UpperFlangeWidth_cm=cm_3,
    LowerFlangeWidth_cm=cm_3,
    mode="Trapezoid")
line_sdl_2 = LineSDL(Start=area.Centroid, Direction=unit_z_5, Length=number_slider_4)
line_to_beam_karamba3d = LineToBeamKaramba3D(Line=line_sdl_2, CrossSection=cross_section_karamba3d, New=True, Remove=True, LimitDistance_m=0.005)  # -> Element, Points, Info

load_karamba3d = LoadKaramba3D(flatten([loads_3, loads, loads_2, loads_6, loads_4, loads_5]))
support_karamba3d = SupportKaramba3D(flatten(supp))
element_karamba3d = ElementKaramba3D(flatten([line_to_beam_karamba3d.Element, meshtoshell.Element]))
assemble_model_karamba3d = AssembleModelKaramba3D(
    Elem=flatten(element_karamba3d),
    Support=flatten(support_karamba3d),
    Load=flatten(load_karamba3d),
    Material=material_properties_karamba3d,
    LimitDistance_m=0.005)  # -> Model, Info, Mass_kg, CenterOfGravity

# ----
# Some cases only show the structural
# result with this component
eigen_modes_karamba3d = EigenModesKaramba3D(Model=assemble_model_karamba3d.Model, FromIndex=1, NumberOfModes=1, MaximumNumberOfIterations=300, Epsilon=1e-07)  # -> ModelWithEigenModesAsLoadCaseResults, Eigenvalues

analyze_karamba3d = AnalyzeKaramba3D(Model=assemble_model_karamba3d.Model)  # -> CalculatedModel, MaximumDisplacement_cm, ResultingForceOfGravity_kN, ElasticEnergy_kNm
model_view_karamba3d = ModelViewKaramba3D(
    Model=analyze_karamba3d.CalculatedModel,
    ResultFactors=1,
    ResultCase=-1,
    Colors=[ColourSwatch(SwatchColor=RGB(243, 205, 121)), ColourSwatch(SwatchColor=RGB(151, 177, 102)), ColourSwatch(SwatchColor=RGB(63, 63, 255)), ColourSwatch(SwatchColor=RGB(196, 159, 189)), ColourSwatch(SwatchColor=RGB(238, 130, 98)), ColourSwatch(SwatchColor=RGB(139, 121, 94))])  # -> Model, DeformedMesh, DeformedAxes, DeformedModel
shell_view_karamba3d = ShellViewKaramba3D(Model=model_view_karamba3d.Model, IndexOfLayer=0)  # -> Model, MeshesOfRenderedShells, LegendColors, LegendTags
legend = Legend(Colour=shell_view_karamba3d.LegendColors, Tags=shell_view_karamba3d.LegendTags, LegendType=1)
