# Grasshopper definition Voxel based analysis.gh (Grasshopper 1.0.7)
# plug-ins: Pufferfish, MeshEdit Components, karambaGH, Kangaroo2 Components, Weaverbird

# ---- group: classroom
# Shell thickness
# Input dome
shell_surface = Surface(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)

# ---- group: classroom / Silhouette
curve = Curve(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)

# ---- group: Creation of the volume of the filling
height_of_the_unit = Slider(5, range=0..10)
bounding_rectangle = BoundingRectangle(Geometry=curve, Plane=PlaneXY(0, 0, 0), Axis=0, Slide=0, Union=True)  # -> Bounding, DimensionX, DimensionY
area = Area(Geometry=bounding_rectangle.Bounding)  # -> Area, Centroid
unit_z = UnitZ(Factor=height_of_the_unit)
move = Move(Geometry=bounding_rectangle.Bounding, Motion=unit_z)  # -> Geometry, Transform
unit_z_2 = UnitZ(Factor=Slider(6, range=0..10))
extrude = Extrude(Base=shell_surface, Direction=unit_z_2)
plane_surface = PlaneSurface(Plane=move.Geometry, XSize=Domain(-10, 10), YSize=Domain(-10, 10))
split_brep = SplitBrep(Brep=extrude, Cutter=plane_surface)
list_item = ListItem(List=split_brep, Index=0, Wrap=True)
cap_holes = CapHoles(Brep=list_item)
mesh_brep = MeshBrep(
    Brep=cap_holes,
    Settings={GridMaxCount=0, GridMinCount=16, JaggedSeams=False, MaxEdgeLength=0, MinEdgeLength=0.0001, MinTolerance=0, Refine=True, RefineAngle=0, RelativeTolerance=0.65, SimplePlanes=True, Tolerance=0})

# ---- group: Shell mesh
mesh = Mesh(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)

# ----
unify_mesh = UnifyMesh(Mesh=mesh)  # -> Result, Count
mesh_2 = Mesh(unify_mesh.Result)

# ---- group: Creation of shell volume
shell_thickness = Slider(0.4, range=0..1)
negative = Negative(Value=shell_thickness)
weaverbird_s_mesh_thicken = WeaverbirdsMeshThicken(MeshCurves=mesh_2, Distance=negative, OffsetType=0)

# ---- group: Points on floor level
meshcorners = MeshCorners(Mesh=mesh_2, Angle=2.35619449)
deconstruct = Deconstruct(Point=meshcorners)  # -> XComponent, YComponent, ZComponent
larger_than = LargerThan(FirstNumber=Slider(0, range=0..100), SecondNumber=deconstruct.ZComponent)  # -> LargerThan, OrEqualTo
cull_pattern = CullPattern(List=meshcorners, CullPattern=larger_than.LargerThan)

# ----
bounding_box = BoundingBox(Content=weaverbird_s_mesh_thicken, Plane=PlaneXY(0, 0, 0))  # -> Box, Box_2
average = Average(Input=cull_pattern)
deconstruct_brep = DeconstructBrep(Brep=bounding_box.Box)  # -> Faces, Edges, Vertices
curve_2 = Curve(deconstruct_brep.Edges)

# ---- group: Base grid
# Calculating amount of cells
# in each direction
size_in_x = Slider(0.2, range=0..1)
size_in_y = Slider(0.2, range=0..1)
xy_plane = XYPlane(Origin=Point(0, 0, 0))
cluster = Cluster(list_3=curve_2, list=curve_2, B_2=size_in_x, list_2=curve_2, B=size_in_y)  # -> length_4, result_2, result
rectangular = Rectangular(Plane=xy_plane, SizeX=size_in_x, SizeY=size_in_y, ExtentX=cluster.result_2, ExtentY=cluster.result)  # -> Cells, flatten(Points)

# ---- group: Move geometry to position
deconstruct_brep_2 = DeconstructBrep(Brep=bounding_rectangle.Bounding)  # -> Faces, Edges, Vertices
list_item_2 = ListItem(List=deconstruct_brep.Vertices, Index=1, Wrap=True)
list_item_3 = ListItem(List=deconstruct_brep_2.Vertices, Index=1, Wrap=True)
move_to_point = MoveToPoint(Geometry=mesh_brep, PointA=list_item_3, PointB=list_item_2)  # -> Moved, Vector, Transform
average_2 = Average(Input=rectangular.Points)
mesh_3 = Mesh(flatten(move_to_point.Moved))
move_to_point_2 = MoveToPoint(Geometry=mesh_3, PointA=average, PointB=average_2)  # -> Moved, Vector, Transform

# ---- group: Creation of wall volumes / Opening outlines
curve_3 = Curve([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])
curve_4 = Curve(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)

# ---- group: Creation of wall volumes
wall_thickness = Slider(0.4, range=0..1)
mesh_4 = Mesh(mesh_2)
cluster_2 = Cluster_2(base=curve_3, base_2=curve_4, mesh=mesh_4, mesh_2=mesh_4, mesh_3=mesh_4, mesh_4=mesh_4)  # -> mesh_7, mesh_8, mesh_5, mesh_6
negative_2 = Negative(Value=wall_thickness)
weaverbird_s_mesh_thicken_2 = WeaverbirdsMeshThicken(MeshCurves=[cluster_2.mesh_7, cluster_2.mesh_5], Distance=wall_thickness, OffsetType=0)
weaverbird_s_mesh_thicken_3 = WeaverbirdsMeshThicken(MeshCurves=[cluster_2.mesh_8, cluster_2.mesh_6], Distance=negative_2, OffsetType=0)

# ----
mesh_5 = Mesh(flatten([weaverbird_s_mesh_thicken_2, weaverbird_s_mesh_thicken_3]))
move_to_point_3 = MoveToPoint(Geometry=mesh_5, PointA=average, PointB=average_2)  # -> Moved, Vector, Transform

# ---- group: Final mesh geometry
mesh_6 = Mesh(graft([move_to_point_3.Moved, move_to_point_2.Moved]))
mesh_join = MeshJoin(Meshes=mesh_6)

# ---- group: Bounding boxes
bounding_box_2 = BoundingBox(Content=flatten(move_to_point_2.Moved), Plane=PlaneXY(0, 0, 0))  # -> Box, Box_2
bounding_box_3 = BoundingBox(Content=flatten(mesh_join), Plane=PlaneXY(0, 0, 0))  # -> Box, Box_2
deconstruct_brep_3 = DeconstructBrep(Brep=bounding_box_2.Box)  # -> Faces, Edges, Vertices
deconstruct_brep_4 = DeconstructBrep(Brep=flatten(bounding_box_3.Box))  # -> Faces, Edges, Vertices
list_item_4 = ListItem(List=deconstruct_brep_3.Edges, Index=2, Wrap=True)
curve_5 = Curve(flatten(deconstruct_brep_4.Edges))

# ---- group: Voxelation grid
# Calculating amount of cells
# in x&y direction
# Calculating amount of cells
# in z direction
length_of_voxel = Slider(0.2, range=0..1)
height_of_voxel = Slider(0.2, range=0..1)
width_of_voxel = Slider(0.2, range=0..1)
xy_plane_2 = XYPlane(Origin=Point(0, 0, 0))
cluster_3 = Cluster(list_3=curve_5, list=curve_5, B_2=length_of_voxel, list_2=curve_5, B=height_of_voxel)  # -> length_4, result_2, result
division = Division(A=cluster_3.length_4, B=height_of_voxel)
rectangular_2 = Rectangular(Plane=xy_plane_2, SizeX=width_of_voxel, SizeY=length_of_voxel, ExtentX=cluster_3.result_2, ExtentY=cluster_3.result)  # -> Cells, flatten(Points)
addition = Addition(A=division, B=1)
area_2 = Area(Geometry=rectangular_2.Cells)  # -> Area, Centroid
series = Series(Start=length_of_voxel, Step=length_of_voxel, Count=addition)
average_3 = Average(Input=flatten(area_2.Centroid))
average_4 = Average(Input=rectangular_2.Points)
unit_z_3 = UnitZ(Factor=series)
move_to_point_4 = MoveToPoint(Geometry=area_2.Centroid, PointA=average_3, PointB=average_4)  # -> Moved, Vector, Transform

# ---- group: Voxelation grid / Refined grid according to the center
point = Point(move_to_point_4.Moved)

# ---- group: Voxelation grid / 3-dimensional grid
move_2 = Move(Geometry=graft(point), Motion=unit_z_3)  # -> simplify(flatten(Geometry)), Transform

# ---- group: Maximum distance for neighboring voxels
division_2 = Division(A=width_of_voxel, B=2)
division_3 = Division(A=length_of_voxel, B=2)
division_4 = Division(A=height_of_voxel, B=2)
square = Square(Value=division_2)
square_2 = Square(Value=division_3)
square_3 = Square(Value=division_4)
mass_addition = MassAddition(Input=[square, square_2, square_3])  # -> Result, PartialResults
square_root = SquareRoot(Value=mass_addition.Result)
multiplication = Multiplication(A=square_root, B=2)

# ---- group: Geometry of individual voxel
rectangle = Rectangle(Plane=PlaneXY(0, 0, 0), XSize=width_of_voxel, YSize=length_of_voxel, Radius=0)  # -> Rectangle, Length
geometry = Geometry(rectangle.Rectangle)
deconstruct_brep_5 = DeconstructBrep(Brep=geometry)  # -> Faces, Edges, Vertices
construct_mesh = ConstructMesh(Vertices=deconstruct_brep_5.Vertices, Faces={A=0, B=1, C=2, D=3})
number = Number(length_of_voxel)
offset_mesh = OffsetMesh(Mesh=construct_mesh, Distance=number, BothSides=0, CreateSolid=True)
volume = Volume(Geometry=offset_mesh)  # -> Volume, Centroid

# ---- group: Center points for application of voxels
mesh_7 = Mesh(mesh_6)
mesh_8 = Mesh(mesh_7)
mesh_inclusion = MeshInclusion(Mesh=mesh_8, Point=move_2.Geometry, Strict=False)
cull_pattern_2 = CullPattern(List=move_2.Geometry, CullPattern=mesh_inclusion)

# ---- group: Analysis of cubic voxel as a mesh / Cubic voxel
brep = Brep(<brep referenced from the Rhino model>)

# ---- group: Volume as voxelated geometry
move_to_point_5 = MoveToPoint(Geometry=offset_mesh, PointA=volume.Centroid, PointB=cull_pattern_2)  # -> Moved, Vector, Transform

# ---- group: Safety factor
safety_factor = Slider(1.5, range=0..10)

# ---- group: Upper floor shell
mesh_9 = Mesh(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)

# ----
mesh_10 = Mesh(move_to_point_2.Moved)
mesh_volume = MeshVolume(Mesh=move_to_point_5.Moved)  # -> Volume, Centroid

# ---- group: Calculation of voxel's surface
multiplication_2 = Multiplication(A=width_of_voxel, B=length_of_voxel)

# ----
point_2 = Point(simplify(flatten(mesh_volume.Centroid)))

# ---- group: Unique center points
removeduplicatepts = RemoveDuplicatePts(Points=point_2, Tolerance=0.01)

# ---- group: Points for application of lateral loads
multiplication_3 = Multiplication(A=Slider(0.2, range=0..1), B=-1)
offset_curve = OffsetCurve(Curve=list_item_4, Distance=multiplication_3, Corners=1)
curve_6 = Curve(list_item_4)
curve_7 = Curve(offset_curve)
end_points = EndPoints(Curve=curve_7)  # -> Start, End
end_points_2 = EndPoints(Curve=curve_6)  # -> Start, End
line = Line(StartPoint=end_points.End, EndPoint=end_points_2.End)
line_2 = Line(StartPoint=end_points.Start, EndPoint=end_points_2.Start)
join_curves = JoinCurves(Curves=flatten([line_2, curve_6, curve_7, line]), Preserve=False)
point_in_curves = PointInCurves(Point=removeduplicatepts, Curves=flatten(join_curves))  # -> Relationship, Index, Point
cull_pattern_3 = CullPattern(List=removeduplicatepts, CullPattern=point_in_curves.Relationship)
point_3 = Point(cull_pattern_3)

# ---- group: Point for vertical loads
point_4 = Point(removeduplicatepts)
deconstruct_2 = Deconstruct(Point=point_4)  # -> XComponent, YComponent, ZComponent
larger_than_2 = LargerThan(FirstNumber=deconstruct_2.ZComponent, SecondNumber=Slider(4.6, range=4.4..5))  # -> LargerThan, OrEqualTo
cull_pattern_4 = CullPattern(List=point_4, CullPattern=larger_than_2.LargerThan)
point_5 = Point(cull_pattern_4)

# ---- group: Live loads
vertical_load = Slider(4, range=0..10)
multiplication_4 = Multiplication(A=vertical_load, B=safety_factor)
# Calculating force
# per voxel surface
multiplication_5 = Multiplication(A=multiplication_2, B=multiplication_4)
negative_3 = Negative(Value=multiplication_5)
Z = UnitZ(Factor=negative_3)
loads = LoadsKaramba3D(ForceVector=Z, Local=False, PosInd=point_5, LCase="0", mode="Point")

# ---- group: Wind load
wind_load = Panel("0.2")
multiplication_6 = Multiplication(A=wind_load, B=safety_factor)
multiplication_7 = Multiplication(A=multiplication_2, B=multiplication_6)
negative_4 = Negative(Value=multiplication_7)
point_6 = Point(point_3)
unit_x = UnitX(Factor=negative_4)
loads_2 = LoadsKaramba3D(ForceVector=unit_x, Local=False, PosInd=point_6, LCase="0", mode="Point")

# ---- group: Analysis of cubic voxel as a mesh / Safety factor
safety_factor_2 = Slider(1.5, range=0..10)

# ----
data_dam = DataDam(DataDataA=removeduplicatepts, BufferDelay=10000000, BufferMode=0)

# ---- group: Possible neighbors & filtering based on maximum distance
closest_points_karamba3d = ClosestPointsKaramba3D(Point=data_dam, Cloud=data_dam, NumberOfNeighbors=Slider(10, range=0..100), LimitDistance=-1)  # -> Points, Index, Distance
point_7 = Point(simplify(closest_points_karamba3d.Points))
flip_matrix = FlipMatrix(Data=point_7)
line_3 = Line(StartPoint=data_dam, EndPoint=flip_matrix)
data = Data(flatten(line_3))
null_item = NullItem(Item=data)  # -> NullFlags, InvalidFlags, Description
dispatch = Dispatch(List=data, DispatchPattern=null_item.InvalidFlags)  # -> ListA, ListB
data_dam_2 = DataDam(DataDataA=dispatch.ListB, BufferDelay=10000000, BufferMode=0)
length = Length(Curve=data_dam_2)
larger_than_3 = LargerThan(FirstNumber=multiplication, SecondNumber=flatten(length))  # -> LargerThan, OrEqualTo
cull_pattern_5 = CullPattern(List=data_dam_2, CullPattern=larger_than_3.LargerThan)  # -> flatten(List)

# ---- group: Material properties
young_s_modulus_n_mm2 = Panel("150")
yield_strength_kn_cm2 = Panel("0.13")
specific_weight_kg_m3 = Panel("1500")
expression = Expression(E=young_s_modulus_n_mm2, Expression="E*1000000")
expression_2 = Expression(E=expression, Expression="E*0.0000001")
expression_3 = Expression(d=specific_weight_kg_m3, Expression="d*0.01")
panel = Panel("Adobe")
panel_2 = Panel(expression_2)
panel_3 = Panel(expression_3)

# ---- group: Points for supports
deconstruct_3 = Deconstruct(Point=data_dam)  # -> XComponent, YComponent, ZComponent
larger_than_4 = LargerThan(FirstNumber=Slider(0.3, range=0..3), SecondNumber=deconstruct_3.ZComponent)  # -> LargerThan, OrEqualTo
cull_pattern_6 = CullPattern(List=data_dam, CullPattern=larger_than_4.LargerThan)

# ----
material_properties_karamba3d = MaterialPropertiesKaramba3D(
    FamilyOfMaterial=panel,
    Name="S235",
    ElementIdentifier="Adobe beams",
    YoungsModulus_kN_cm2=panel_2,
    InPlaneShearModulus_kN_cm2=expr("x/2.5", panel_2),
    TransverseShearModulus_kN_cm2=8076,
    SpecificWeight_kN_m3=panel_3,
    CoefficientOfThermalExpansion_1_C=1e-05,
    YieldStrength_kN_cm2=yield_strength_kn_cm2,
    mode="Isotrop")
data_dam_3 = DataDam(DataDataA=cull_pattern_5, BufferDelay=10000000, BufferMode=0)
support_karamba3d = SupportKaramba3D(PosInd=cull_pattern_6, menu=[buttons(on, on, on, on, on, on)])
remove_duplicate_lines_karamba3d = RemoveDuplicateLinesKaramba3D(Line=data_dam_3, LimitDistance=0.005)  # -> OutLine, Info, Indexes

# ---- group: Beam elements
thickness = Slider(1.5, range=0..5)
diameter = Slider(8, range=0..50)
cross_section_karamba3d = CrossSectionKaramba3D(
    FamilyNameOfCrossSection="DefaultCroSec",
    ElementIdentifier="Adobe beams",
    Material=material_properties_karamba3d,
    Diameter_cm=diameter,
    WallThickness_cm=thickness,
    mode="Circular Hollow")
line_to_beam_karamba3d = LineToBeamKaramba3D(
    Line=remove_duplicate_lines_karamba3d.OutLine,
    Identifier="Adobe beams",
    CrossSection=cross_section_karamba3d,
    New=True,
    Remove=True,
    LimitDistance_m=0.005)  # -> Element, Points, Info

# ----
point_8 = Point(line_to_beam_karamba3d.Points)

# ---- group: Load of the Filling
mesh_volume_2 = MeshVolume(Mesh=mesh_10)  # -> Volume, Centroid
density_kg_m3 = Panel("1500")
floor_area_m2 = Slider(48, range=0..100)
multiplication_8 = Multiplication(A=mesh_volume_2.Volume, B=density_kg_m3)
division_5 = Division(A=multiplication_8, B=floor_area_m2)
tranform_in_kn = Panel("0.01")
multiplication_9 = Multiplication(A=division_5, B=tranform_in_kn)
multiplication_10 = Multiplication(A=multiplication_9, B=safety_factor)
panel_4 = Panel(multiplication_9)  # "kn/m2"
multiplication_11 = Multiplication(A=multiplication_2, B=multiplication_10)
negative_5 = Negative(Value=multiplication_11)
unit_z_4 = UnitZ(Factor=negative_5)
loads_3 = LoadsKaramba3D(ForceVector=unit_z_4, Local=False, PosInd=flatten(point_8), LCase="0", mode="Point")

# ---- group: Analysis of cubic voxel as truss network / Safety factor
# Compaison for cross section definition
safety_factor_3 = Slider(1.5, range=0..10)

# ---- group: Transformation to trusses
modify_element_karamba3d = ModifyElementKaramba3D(
    Beam=line_to_beam_karamba3d.Element,
    BeamIdentifierIndex="Adobe beams2",
    Bending="false",
    CrossSection=cross_section_karamba3d,
    ConsiderBuckling="false",
    mode="Beam")

# ----
beam_joints_karamba3d = BeamJointsKaramba3D(
    ElementIdentifiers=modify_element_karamba3d,
    CtKNMAtStartingNode=Vector(0, 0, 0),
    CrKNmRadAtStartingNode=Vector(0, 0, 0),
    CtKNMAtEndNode=Vector(0, 0, 0),
    CrKNmRadAtEndNode=Vector(0, 0, 0),
    menu=[buttons(off, off, off, on, on, on), buttons(off, off, off, on, on, on)])

# ---- group: Analysis of cubic voxel as a mesh
deconstruct_brep_6 = DeconstructBrep(Brep=brep)  # -> Faces, Edges, Vertices
cull_index = CullIndex(List=deconstruct_brep_6.Faces, Indices=Slider(4, range=0..4), Wrap=True)
brep_join = BrepJoin(Breps=cull_index)  # -> Breps, Closed
mesh_brep_2 = MeshBrep(
    Brep=brep_join.Breps,
    Settings={GridMaxCount=0, GridMinCount=16, JaggedSeams=False, MaxEdgeLength=0, MinEdgeLength=0.0001, MinTolerance=0, Refine=True, RefineAngle=0, RelativeTolerance=0.65, SimplePlanes=True, Tolerance=0})
mesh_11 = Mesh(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)
mesh_12 = Mesh(move_to_point_2.Moved)

# ---- group: Analysis of cubic voxel as a mesh / Points for supports
deconstruct_mesh = DeconstructMesh(Mesh=mesh_brep_2)  # -> Vertices, Faces, Colours, Normals
deconstruct_4 = Deconstruct(Point=deconstruct_mesh.Vertices)  # -> XComponent, YComponent, ZComponent
larger_than_5 = LargerThan(FirstNumber=Slider(0.1, range=0..0.1), SecondNumber=deconstruct_4.ZComponent)  # -> LargerThan, OrEqualTo
dispatch_2 = Dispatch(List=deconstruct_mesh.Vertices, DispatchPattern=larger_than_5.OrEqualTo)  # -> ListA, ListB
removeduplicatepts_2 = RemoveDuplicatePts(Points=dispatch_2.ListA, Tolerance=0.01)
support_karamba3d_2 = SupportKaramba3D(PosInd=removeduplicatepts_2, menu=[buttons(on, on, on, on, on, on)])

# ---- group: Analysis of cubic voxel as a mesh / Mesh for analysis
cross_section_karamba3d_2 = CrossSectionKaramba3D(
    FamilyNameOfCrossSection="DefaultCroSec",
    Material=material_properties_karamba3d,
    Height_cm=Slider(3, range=0..10),
    mode="Shell - Const")
mesh_to_shell_karamba3d = MeshToShellKaramba3D(Mesh=mesh_brep_2, CrossSection=cross_section_karamba3d_2, LimitDistance_m=0.005)  # -> Element, Points, Info

# ----
removeduplicatepts_3 = RemoveDuplicatePts(Points=dispatch_2.ListB, Tolerance=0.01)

# ---- group: Analysis of cubic voxel as a mesh / Load of the Upper Floor
negative_6 = Negative(Value=Slider(0.25, range=0..1))
offset_mesh_2 = OffsetMesh(Mesh=mesh_11, Distance=negative_6, BothSides=0, CreateSolid=True)
mesh_join_2 = MeshJoin(Meshes=flatten(offset_mesh_2))
mesh_volume_3 = MeshVolume(Mesh=mesh_join_2)  # -> Volume, Centroid
floor_area_m2_2 = Slider(48, range=0..100)
density_kg_m3_2 = Panel("1500")
multiplication_12 = Multiplication(A=mesh_volume_3.Volume, B=density_kg_m3_2)
tranform_in_kn_2 = Panel("0.01")
division_6 = Division(A=multiplication_12, B=floor_area_m2_2)
multiplication_13 = Multiplication(A=division_6, B=tranform_in_kn_2)
multiplication_14 = Multiplication(A=multiplication_13, B=safety_factor_2)
panel_5 = Panel(multiplication_13)  # "kn/m2"
panel_6 = Panel(multiplication_14)  # "kn/m2"
negative_7 = Negative(Value=multiplication_14)
unit_z_5 = UnitZ(Factor=negative_7)
loads_4 = LoadsKaramba3D(ForceVector=unit_z_5, Local=False, PosInd=flatten(removeduplicatepts_3), LCase="0", mode="Point")

# ---- group: Analysis of cubic voxel as truss network / Supports
point_9 = Point(deconstruct_brep_6.Vertices)
removeduplicatepts_4 = RemoveDuplicatePts(Points=point_9, Tolerance=0.01)
deconstruct_5 = Deconstruct(Point=removeduplicatepts_4)  # -> XComponent, YComponent, ZComponent
larger_than_6 = LargerThan(FirstNumber=Slider(0.1, range=0..1), SecondNumber=deconstruct_5.ZComponent)  # -> LargerThan, OrEqualTo
dispatch_3 = Dispatch(List=point_9, DispatchPattern=larger_than_6.OrEqualTo)  # -> ListA, ListB
point_10 = Point(dispatch_3.ListA)
support_karamba3d_3 = SupportKaramba3D(PosInd=point_10, menu=[buttons(on, on, on, on, on, on)])

# ---- group: Analysis of cubic voxel as truss network / Analysis
diameter_2 = Slider(8, range=0..100)
thickness_2 = Slider(1.5, range=0..5)
curve_8 = Curve(deconstruct_brep_6.Edges)
cross_section_karamba3d_3 = CrossSectionKaramba3D(
    FamilyNameOfCrossSection="DefaultCroSec",
    ElementIdentifier="Adobe beams 3",
    Material=material_properties_karamba3d,
    Diameter_cm=diameter_2,
    WallThickness_cm=thickness_2,
    mode="Circular Hollow")
line_to_beam_karamba3d_2 = LineToBeamKaramba3D(
    Line=curve_8,
    Identifier="Adobe beams 3",
    CrossSection=cross_section_karamba3d_3,
    New=True,
    Remove=True,
    LimitDistance_m=0.005)  # -> Element, Points, Info
modify_element_karamba3d_2 = ModifyElementKaramba3D(
    Beam=line_to_beam_karamba3d_2.Element,
    BeamIdentifierIndex="Adobe beams4",
    Bending="false",
    CrossSection=cross_section_karamba3d_3,
    ConsiderBuckling="false",
    mode="Beam")

# ---- group: Load of the Upper Floor
shell_thickness_2 = Slider(0.4, range=0..1)
negative_8 = Negative(Value=shell_thickness_2)
offset_mesh_3 = OffsetMesh(Mesh=mesh_9, Distance=negative_8, BothSides=0, CreateSolid=True)
mesh_join_3 = MeshJoin(Meshes=flatten(offset_mesh_3))
mesh_volume_4 = MeshVolume(Mesh=mesh_join_3)  # -> Volume, Centroid
floor_area_m2_3 = Slider(48, range=0..100)
density_kg_m3_3 = Panel("1500")
multiplication_15 = Multiplication(A=mesh_volume_4.Volume, B=density_kg_m3_3)
tranform_in_kn_3 = Panel("0.01")
division_7 = Division(A=multiplication_15, B=floor_area_m2_3)
multiplication_16 = Multiplication(A=division_7, B=tranform_in_kn_3)
panel_7 = Panel(multiplication_16)  # "kn/m2"
multiplication_17 = Multiplication(A=multiplication_16, B=safety_factor)
panel_8 = Panel(multiplication_17)  # "kn/m2"

# ----
multiplication_18 = Multiplication(A=multiplication_2, B=multiplication_17)

# ---- group: Load of the Upper Floor (continued)
negative_9 = Negative(Value=multiplication_18)
unit_z_6 = UnitZ(Factor=negative_9)
loads_5 = LoadsKaramba3D(ForceVector=unit_z_6, Local=False, PosInd=flatten(point_5), LCase="0", mode="Point")

# ---- group: Sand load
estimated_height_of_sand_layer = Slider(0.05, range=0..0.1)
vertical_load_2 = Slider(15, range=0..15)

# ----
multiplication_19 = Multiplication(A=vertical_load_2, B=estimated_height_of_sand_layer)

# ---- group: Sand load (continued)
multiplication_20 = Multiplication(A=multiplication_19, B=safety_factor)

# ----
multiplication_21 = Multiplication(A=multiplication_2, B=multiplication_20)

# ---- group: Sand load (continued)
negative_10 = Negative(Value=multiplication_21)
Z_2 = UnitZ(Factor=negative_10)
loads_6 = LoadsKaramba3D(ForceVector=Z_2, Local=False, PosInd=point_5, LCase="0", mode="Point")

# ----
load_karamba3d = LoadKaramba3D(flatten([loads, loads_3, loads_5, loads_6, loads_2]))

# ---- group: Analysis
assemble_model_karamba3d = AssembleModelKaramba3D(
    Elem=flatten(modify_element_karamba3d),
    Support=flatten(support_karamba3d),
    Load=flatten(load_karamba3d),
    CrossSection=cross_section_karamba3d,
    Material=material_properties_karamba3d,
    Joint=beam_joints_karamba3d,
    LimitDistance_m=0.005)  # -> flatten(Model), Info, Mass_kg, CenterOfGravity
data_dam_4 = DataDam(DataDataA=assemble_model_karamba3d.Model, BufferDelay=10000000, BufferMode=0)
analyze_karamba3d = AnalyzeKaramba3D(Model=data_dam_4)  # -> CalculatedModel, MaximumDisplacement_cm, ResultingForceOfGravity_kN, ElasticEnergy_kNm

# ---- group: Nodal displacement vectors
nodal_displacements_karamba3d = NodalDisplacementsKaramba3D(AnalyzedModel=analyze_karamba3d.CalculatedModel, ResultCase=0)  # -> AnalyzedModel, NodalTranslations_m, NodalRotations_rad
point_11 = Point(simplify(removeduplicatepts))
vector_length = VectorLength(Vector=flatten(nodal_displacements_karamba3d.NodalTranslations_m))
vector_scale = Slider(0.2, range=0..5)
bnd = Bounds(Numbers=vector_length)
dedomain = DeconstructDomain(Domain=bnd)  # -> Start, End
gradient = Gradient(
    LowerLimit=dedomain.Start,
    UpperLimit=dedomain.End,
    Parameter=vector_length,
    stops=[0: RGB(78, 31, 168), 0: RGB(195, 97, 55), 0: RGB(145, 101, 12), 0: RGB(211, 27, 5), 0: RGB(234, 38, 0), 0.25: RGB(234, 126, 0), 0.504: RGB(254, 244, 84), 0.706: RGB(75, 107, 169), 0.989: RGB(173, 203, 249)])
multiplication_22 = Multiplication(A=nodal_displacements_karamba3d.NodalTranslations_m, B=vector_scale)
vdisex = VectorDisplayEx(Point=point_11, Vector=flatten(multiplication_22), Colour=gradient, Width=Slider(2, range=0..5))

# ---- group: Stress analysis
colour_swatch = ColourSwatch(SwatchColor=RGB(97, 33, 129))
model_view_karamba3d = ModelViewKaramba3D(
    Model=analyze_karamba3d.CalculatedModel,
    ResultFactors=1,
    ResultCase=-1,
    Colors=[ColourSwatch(SwatchColor=RGB(235, 229, 148)), ColourSwatch(SwatchColor=RGB(116, 213, 148)), ColourSwatch(SwatchColor=RGB(23, 136, 148)), ColourSwatch(SwatchColor=RGB(205, 128, 129)), ColourSwatch(SwatchColor=RGB(208, 27, 129))])  # -> Model, DeformedMesh, DeformedAxes, DeformedModel
beam_view_karamba3d = BeamViewKaramba3D(Model=model_view_karamba3d.Model)  # -> Model, MeshesOfRenderedBeams, DeformedBeamAxes, LegendColors, LegendTags; disabled
legend = Legend(Colour=beam_view_karamba3d.LegendColors, Tags=beam_view_karamba3d.LegendTags, LegendType=1)

# ---- group: Analysis of cubic voxel as a mesh (continued)
point_12 = Point(removeduplicatepts_3)

# ---- group: Analysis of cubic voxel as a mesh / Load of the Filling
mesh_volume_5 = MeshVolume(Mesh=mesh_12)  # -> Volume, Centroid
floor_area_m2_4 = Slider(48, range=0..100)
density_kg_m3_4 = Panel("1500")
multiplication_23 = Multiplication(A=mesh_volume_5.Volume, B=density_kg_m3_4)
division_8 = Division(A=multiplication_23, B=floor_area_m2_4)
tranform_in_kn_4 = Panel("0.01")
multiplication_24 = Multiplication(A=division_8, B=tranform_in_kn_4)
panel_9 = Panel(multiplication_24)  # "kn/m2"
multiplication_25 = Multiplication(A=multiplication_24, B=safety_factor_2)
panel_10 = Panel(multiplication_25)  # "kn/m2"
negative_11 = Negative(Value=multiplication_25)
unit_z_7 = UnitZ(Factor=negative_11)
loads_7 = LoadsKaramba3D(ForceVector=unit_z_7, Local=False, PosInd=flatten(point_12), LCase="0", mode="Point")

# ---- group: Analysis of cubic voxel as a mesh / Live loads
vertical_load_3 = Slider(4, range=0..10)
multiplication_26 = Multiplication(A=vertical_load_3, B=safety_factor_2)
negative_12 = Negative(Value=multiplication_26)
Z_3 = UnitZ(Factor=negative_12)
loads_8 = LoadsKaramba3D(ForceVector=Z_3, Local=False, PosInd=point_12, LCase="0", mode="Point")

# ---- group: Analysis of cubic voxel as a mesh (continued)
load_karamba3d_2 = LoadKaramba3D([loads_4, loads_7, loads_8])

# ---- group: Analysis of cubic voxel as a mesh / Analysis
assemble_model_karamba3d_2 = AssembleModelKaramba3D(
    Elem=flatten(mesh_to_shell_karamba3d.Element),
    Support=flatten(support_karamba3d_2),
    Load=flatten(load_karamba3d_2),
    Material=material_properties_karamba3d,
    LimitDistance_m=0.005)  # -> flatten(Model), Info, Mass_kg, CenterOfGravity
analyze_karamba3d_2 = AnalyzeKaramba3D(Model=assemble_model_karamba3d_2.Model)  # -> CalculatedModel, MaximumDisplacement_cm, ResultingForceOfGravity_kN, ElasticEnergy_kNm
model_view_karamba3d_2 = ModelViewKaramba3D(Model=analyze_karamba3d_2.CalculatedModel, ResultFactors=1, ResultCase=-1)  # -> Model, DeformedMesh, DeformedAxes, DeformedModel
shell_view_karamba3d = ShellViewKaramba3D(Model=model_view_karamba3d_2.Model, IndexOfLayer=0)  # -> Model, MeshesOfRenderedShells, LegendColors, LegendTags

# ---- group: Analysis of cubic voxel as truss network / Load of the Upper Floor
negative_13 = Negative(Value=Slider(0.25, range=0..1))
offset_mesh_4 = OffsetMesh(Mesh=mesh_11, Distance=negative_13, BothSides=0, CreateSolid=True)
mesh_join_4 = MeshJoin(Meshes=flatten(offset_mesh_4))
mesh_volume_6 = MeshVolume(Mesh=mesh_join_4)  # -> Volume, Centroid
floor_area_m2_5 = Slider(48, range=0..100)
density_kg_m3_5 = Panel("1500")
multiplication_27 = Multiplication(A=mesh_volume_6.Volume, B=density_kg_m3_5)
tranform_in_kn_5 = Panel("0.01")
division_9 = Division(A=multiplication_27, B=floor_area_m2_5)
multiplication_28 = Multiplication(A=division_9, B=tranform_in_kn_5)
multiplication_29 = Multiplication(A=multiplication_28, B=safety_factor_3)
panel_11 = Panel(multiplication_28)  # "kn/m2"
panel_12 = Panel(multiplication_29)  # "kn/m2"

# ---- group: Analysis of cubic voxel as truss network / Load of the Filling
mesh_volume_7 = MeshVolume(Mesh=mesh_12)  # -> Volume, Centroid
floor_area_m2_6 = Slider(48, range=0..100)
density_kg_m3_6 = Panel("1500")
multiplication_30 = Multiplication(A=mesh_volume_7.Volume, B=density_kg_m3_6)
division_10 = Division(A=multiplication_30, B=floor_area_m2_6)
tranform_in_kn_6 = Panel("0.01")
multiplication_31 = Multiplication(A=division_10, B=tranform_in_kn_6)
multiplication_32 = Multiplication(A=multiplication_31, B=safety_factor_3)
panel_13 = Panel(multiplication_31)  # "kn/m2"
panel_14 = Panel(multiplication_32)  # "kn/m2"

# ---- group: Analysis of cubic voxel as truss network / Live loads
vertical_load_4 = Slider(7, range=0..10)
multiplication_33 = Multiplication(A=vertical_load_4, B=safety_factor_3)

# ---- group: Analysis of cubic voxel as truss network
removeduplicatepts_5 = RemoveDuplicatePts(Points=dispatch_3.ListB, Tolerance=0.01)
point_13 = Point(removeduplicatepts_5)
multiplication_34 = Multiplication(A=multiplication_2, B=multiplication_33)
multiplication_35 = Multiplication(A=multiplication_2, B=multiplication_32)
multiplication_36 = Multiplication(A=multiplication_2, B=multiplication_29)

# ---- group: Analysis of cubic voxel as truss network / Live loads (continued)
negative_14 = Negative(Value=multiplication_34)
Z_4 = UnitZ(Factor=negative_14)
loads_9 = LoadsKaramba3D(ForceVector=Z_4, Local=False, PosInd=point_13, LCase="0", mode="Point")

# ---- group: Analysis of cubic voxel as truss network / Load of the Filling (continued)
negative_15 = Negative(Value=multiplication_35)
unit_z_8 = UnitZ(Factor=negative_15)
loads_10 = LoadsKaramba3D(ForceVector=unit_z_8, Local=False, PosInd=flatten(point_13), LCase="0", mode="Point")

# ---- group: Analysis of cubic voxel as truss network / Load of the Upper Floor (continued)
negative_16 = Negative(Value=multiplication_36)
unit_z_9 = UnitZ(Factor=negative_16)
loads_11 = LoadsKaramba3D(ForceVector=unit_z_9, Local=False, PosInd=flatten(removeduplicatepts_3), LCase="0", mode="Point")

# ---- group: Analysis of cubic voxel as truss network (continued)
load_karamba3d_3 = LoadKaramba3D([loads_11, loads_10, loads_9])
assemble_model_karamba3d_3 = AssembleModelKaramba3D(
    Elem=flatten(modify_element_karamba3d_2),
    Support=flatten(support_karamba3d_3),
    Load=flatten(load_karamba3d_3),
    CrossSection=cross_section_karamba3d,
    Material=material_properties_karamba3d,
    LimitDistance_m=0.005)  # -> flatten(Model), Info, Mass_kg, CenterOfGravity
analyze_karamba3d_3 = AnalyzeKaramba3D(Model=assemble_model_karamba3d_3.Model)  # -> CalculatedModel, MaximumDisplacement_cm, ResultingForceOfGravity_kN, ElasticEnergy_kNm
model_view_karamba3d_3 = ModelViewKaramba3D(Model=analyze_karamba3d_3.CalculatedModel, ResultFactors=1, ResultCase=-1)  # -> Model, DeformedMesh, DeformedAxes, DeformedModel
beam_view_karamba3d_2 = BeamViewKaramba3D(Model=model_view_karamba3d_3.Model)  # -> Model, MeshesOfRenderedBeams, DeformedBeamAxes, LegendColors, LegendTags

# ==== cluster Cluster
list = ClusterInput()
list_2 = ClusterInput()
list_3 = ClusterInput()
list_item = ListItem(List=flatten(list_3), Index=Slider(56, range=0..60), Wrap=True)

# ---- group: X direction
list_item_2 = ListItem(List=list, Index=Slider(50, range=0..60), Wrap=True)
length = Length(Curve=list_item_2)

# ---- group: Y direction
list_item_3 = ListItem(List=list_2, Index=Slider(49, range=0..60), Wrap=True)
length_2 = Length(Curve=list_item_3)

# ----
length_3 = Length(Curve=list_item)
B = ClusterInput()
B_2 = ClusterInput()
division = Division(A=length_2, B=B)
division_2 = Division(A=length, B=B_2)
length_4 = ClusterOutput(length_3)
multiplication = Multiplication(A=division, B=Slider(1.2, range=0..10))
multiplication_2 = Multiplication(A=division_2, B=Slider(1.2, range=0..10))
panel = Panel(length)
result = ClusterOutput(division)
result_2 = ClusterOutput(division_2)

# ==== cluster Cluster_2
mesh = ClusterInput()
mesh_2 = ClusterInput()
mesh_3 = ClusterInput()
mesh_4 = ClusterInput()
mesh_edges = MeshEdges(Mesh=mesh)  # -> NakedEdges, InteriorEdges, NonManifoldEdges
mesh_edges_2 = MeshEdges(Mesh=mesh_2)  # -> NakedEdges, InteriorEdges, NonManifoldEdges
mesh_edges_3 = MeshEdges(Mesh=mesh_3)  # -> NakedEdges, InteriorEdges, NonManifoldEdges
mesh_edges_4 = MeshEdges(Mesh=mesh_4)  # -> NakedEdges, InteriorEdges, NonManifoldEdges
curve = Curve(mesh_edges.NakedEdges)
curve_2 = Curve(mesh_edges_2.NakedEdges)
curve_3 = Curve(mesh_edges_3.NakedEdges)
curve_4 = Curve(mesh_edges_4.NakedEdges)
end_points = EndPoints(Curve=curve)  # -> Start, End
end_points_2 = EndPoints(Curve=curve_2)  # -> Start, End
end_points_3 = EndPoints(Curve=curve_3)  # -> Start, End
end_points_4 = EndPoints(Curve=curve_4)  # -> Start, End
point = Point([end_points.End, end_points.Start])
point_2 = Point([end_points_2.End, end_points_2.Start])
point_3 = Point([end_points_3.End, end_points_3.Start])
point_4 = Point([end_points_4.End, end_points_4.Start])
delete_consecutive = DeleteConsecutive(Set=point, Wrap=False)  # -> Set, Count
delete_consecutive_2 = DeleteConsecutive(Set=point_2, Wrap=False)  # -> Set, Count
delete_consecutive_3 = DeleteConsecutive(Set=point_3, Wrap=False)  # -> Set, Count
delete_consecutive_4 = DeleteConsecutive(Set=point_4, Wrap=False)  # -> Set, Count
list_length = ListLength(List=delete_consecutive.Set)
list_length_2 = ListLength(List=delete_consecutive_2.Set)
list_length_3 = ListLength(List=delete_consecutive_3.Set)
list_length_4 = ListLength(List=delete_consecutive_4.Set)
deconstruct = Deconstruct(Point=delete_consecutive.Set)  # -> XComponent, YComponent, ZComponent
deconstruct_2 = Deconstruct(Point=delete_consecutive_2.Set)  # -> XComponent, YComponent, ZComponent
deconstruct_3 = Deconstruct(Point=delete_consecutive_3.Set)  # -> XComponent, YComponent, ZComponent
deconstruct_4 = Deconstruct(Point=delete_consecutive_4.Set)  # -> XComponent, YComponent, ZComponent
series = Series(Start=0, Step=1, Count=list_length)
series_2 = Series(Start=0, Step=1, Count=list_length_2)
series_3 = Series(Start=0, Step=1, Count=list_length_3)
series_4 = Series(Start=0, Step=1, Count=list_length_4)
sort_list = SortList(Keys=deconstruct.YComponent, ValuesValuesA=series)  # -> Keys, ValuesValuesA
sort_list_2 = SortList(Keys=deconstruct_2.YComponent, ValuesValuesA=series_2)  # -> Keys, reverse(ValuesValuesA)
sort_list_3 = SortList(Keys=deconstruct_3.XComponent, ValuesValuesA=series_3)  # -> Keys, reverse(ValuesValuesA)
sort_list_4 = SortList(Keys=deconstruct_4.XComponent, ValuesValuesA=series_4)  # -> Keys, ValuesValuesA
split_list = SplitList(List=sort_list.ValuesValuesA, Index=Slider(20, range=0..100))  # -> ListA, ListB
split_list_2 = SplitList(List=sort_list_2.ValuesValuesA, Index=Slider(20, range=0..100))  # -> ListA, ListB
split_list_3 = SplitList(List=sort_list_3.ValuesValuesA, Index=Slider(20, range=0..100))  # -> ListA, ListB
split_list_4 = SplitList(List=sort_list_4.ValuesValuesA, Index=Slider(20, range=0..100))  # -> ListA, ListB
list_item = ListItem(List=delete_consecutive.Set, Index=split_list.ListA, Wrap=True)
list_item_2 = ListItem(List=delete_consecutive_2.Set, Index=split_list_2.ListA, Wrap=True)
list_item_3 = ListItem(List=delete_consecutive_3.Set, Index=split_list_3.ListA, Wrap=True)
list_item_4 = ListItem(List=delete_consecutive_4.Set, Index=split_list_4.ListA, Wrap=True)
list_length_5 = ListLength(List=list_item)
list_length_6 = ListLength(List=list_item_2)
list_length_7 = ListLength(List=list_item_3)
list_length_8 = ListLength(List=list_item_4)
deconstruct_5 = Deconstruct(Point=list_item)  # -> XComponent, YComponent, ZComponent
deconstruct_6 = Deconstruct(Point=list_item_2)  # -> XComponent, YComponent, ZComponent
deconstruct_7 = Deconstruct(Point=list_item_3)  # -> XComponent, YComponent, ZComponent
deconstruct_8 = Deconstruct(Point=list_item_4)  # -> XComponent, YComponent, ZComponent
series_5 = Series(Start=0, Step=1, Count=list_length_5)
series_6 = Series(Start=0, Step=1, Count=list_length_6)
series_7 = Series(Start=0, Step=1, Count=list_length_7)
series_8 = Series(Start=0, Step=1, Count=list_length_8)
sort_list_5 = SortList(Keys=deconstruct_5.XComponent, ValuesValuesA=series_5)  # -> Keys, ValuesValuesA
sort_list_6 = SortList(Keys=deconstruct_6.XComponent, ValuesValuesA=series_6)  # -> Keys, ValuesValuesA
sort_list_7 = SortList(Keys=deconstruct_7.YComponent, ValuesValuesA=series_7)  # -> Keys, ValuesValuesA
sort_list_8 = SortList(Keys=deconstruct_8.YComponent, ValuesValuesA=series_8)  # -> Keys, ValuesValuesA
list_item_5 = ListItem(List=list_item, Index=sort_list_5.ValuesValuesA, Wrap=True)
list_item_6 = ListItem(List=list_item_2, Index=sort_list_6.ValuesValuesA, Wrap=True)
list_item_7 = ListItem(List=list_item_3, Index=sort_list_7.ValuesValuesA, Wrap=True)
list_item_8 = ListItem(List=list_item_4, Index=sort_list_8.ValuesValuesA, Wrap=True)
delete_consecutive_5 = DeleteConsecutive(Set=list_item_5, Wrap=False)  # -> Set, Count
delete_consecutive_6 = DeleteConsecutive(Set=list_item_6, Wrap=False)  # -> Set, Count
polyline = PolyLine(Vertices=list_item_7, Closed=Toggle(True))
polyline_2 = PolyLine(Vertices=list_item_8, Closed=Toggle(True))
unit_y = UnitY(Factor=1)
unit_y_2 = UnitY(Factor=1)
boundary_surfaces = BoundarySurfaces(Edges=polyline)
boundary_surfaces_2 = BoundarySurfaces(Edges=polyline_2)
polyline_3 = PolyLine(Vertices=delete_consecutive_5.Set, Closed=Toggle(True))
polyline_4 = PolyLine(Vertices=delete_consecutive_6.Set, Closed=Toggle(True))
base = ClusterInput()
base_2 = ClusterInput()
mesh_brep = MeshBrep(
    Brep=boundary_surfaces,
    Settings={GridMaxCount=0, GridMinCount=16, JaggedSeams=False, MaxEdgeLength=0, MinEdgeLength=0.0001, MinTolerance=0, Refine=True, RefineAngle=0, RelativeTolerance=0.65, SimplePlanes=True, Tolerance=0})
mesh_brep_2 = MeshBrep(
    Brep=boundary_surfaces_2,
    Settings={GridMaxCount=0, GridMinCount=16, JaggedSeams=False, MaxEdgeLength=0, MinEdgeLength=0.0001, MinTolerance=0, Refine=True, RefineAngle=0, RelativeTolerance=0.65, SimplePlanes=True, Tolerance=0})
extrude = Extrude(Base=base, Direction=unit_y)
boundary_surfaces_3 = BoundarySurfaces(Edges=flatten(polyline_3))
extrude_2 = Extrude(Base=base_2, Direction=unit_y_2)
boundary_surfaces_4 = BoundarySurfaces(Edges=flatten(polyline_4))
mesh_5 = ClusterOutput(mesh_brep)
mesh_6 = ClusterOutput(mesh_brep_2)
brep_brep = BrepBrep(BrepA=extrude, BrepB=boundary_surfaces_3)  # -> Curves, Points
brep_brep_2 = BrepBrep(BrepA=extrude_2, BrepB=boundary_surfaces_4)  # -> Curves, Points
boundary_surfaces_5 = BoundarySurfaces(Edges=flatten([brep_brep.Curves, polyline_3]))
boundary_surfaces_6 = BoundarySurfaces(Edges=flatten([brep_brep_2.Curves, polyline_4]))
mesh_brep_3 = MeshBrep(
    Brep=boundary_surfaces_5,
    Settings={GridMaxCount=0, GridMinCount=16, JaggedSeams=False, MaxEdgeLength=0, MinEdgeLength=0.0001, MinTolerance=0, Refine=True, RefineAngle=0, RelativeTolerance=0.65, SimplePlanes=True, Tolerance=0})
mesh_brep_4 = MeshBrep(
    Brep=boundary_surfaces_6,
    Settings={GridMaxCount=0, GridMinCount=16, JaggedSeams=False, MaxEdgeLength=0, MinEdgeLength=0.0001, MinTolerance=0, Refine=True, RefineAngle=0, RelativeTolerance=0.65, SimplePlanes=True, Tolerance=0})
mesh_7 = ClusterOutput(mesh_brep_3)
mesh_8 = ClusterOutput(mesh_brep_4)
