# Grasshopper definition Brick layering.gh (Grasshopper 1.0.7)
# plug-ins: Pufferfish, Kangaroo2 Components, Weaverbird, karambaGH

# Shifting of bricks
number_slider = Slider(1, range=0..10)
# Shifting of bricks
number_slider_2 = Slider(2, range=0..10)
# Shifting of bricks
number_slider_3 = Slider(2, range=0..10)
# Input dome
mesh = Mesh(<mesh referenced from the Rhino model>)

layers_in_z = Slider(10, range=0..10)
# First type of brick
size_in_y = Slider(0.4, range=0..1)
size_in_z = Slider(0.2, range=0..1)
size_in_x = Slider(0.2, range=0..1)
xy_plane = XYPlane(Origin=Point(0, 0, 0))

layers_in_z_2 = Slider(10, range=0..10)
size_in_y_2 = Slider(0.2, range=0..1)
# Second type of brick
size_in_z_2 = Slider(0.1, range=0..1)
size_in_x_2 = Slider(0.1, range=0..1)
xy_plane_2 = XYPlane(Origin=Point(0, 0, 0))

size_in_x_3 = Slider(0.3, range=0..1)
size_in_y_3 = Slider(0.15, range=0..1)
xy_plane_3 = XYPlane(Origin=Point(0, 0, 0))
unify_mesh = UnifyMesh(Mesh=mesh)  # -> Result, Count

size_in_y_4 = Slider(0.1, range=0..1)
# Third type of brick
size_in_z_3 = Slider(0.05, range=0..1)
size_in_x_4 = Slider(0.1, range=0..1)
xy_plane_4 = XYPlane(Origin=Point(0, 0, 0))

number = Number(size_in_y)
number_2 = Number(size_in_x)
mesh_2 = Mesh(unify_mesh.Result)
number_3 = Number(size_in_y_2)
number_4 = Number(size_in_x_2)
division = Division(A=size_in_y, B=number_slider)
number_5 = Number(size_in_y_4)
number_6 = Number(size_in_x_4)
division_2 = Division(A=size_in_x, B=number_slider)
division_3 = Division(A=size_in_y_2, B=number_slider_2)
division_4 = Division(A=size_in_x_2, B=number_slider_2)
division_5 = Division(A=size_in_y_4, B=number_slider_3)
division_6 = Division(A=size_in_x_4, B=number_slider_3)
meshcorners = MeshCorners(Mesh=mesh_2, Angle=2.35619449)
deconstruct = Deconstruct(Point=meshcorners)  # -> XComponent, YComponent, ZComponent
number_slider_4 = Slider(0.4, range=0..1)
unify_mesh_2 = UnifyMesh(Mesh=mesh_2)  # -> Result, Count

# ----
# Window outlines
curve = Curve(<curve referenced from the Rhino model>)
curve_2 = Curve([<curve referenced from the Rhino model> x2])
mesh_3 = Mesh(mesh_2)

unit_x = UnitX(Factor=division_2)
unit_y = UnitY(Factor=division)
unit_x_2 = UnitX(Factor=division_4)
unit_y_2 = UnitY(Factor=division_3)
unit_x_3 = UnitX(Factor=division_6)
unit_y_3 = UnitY(Factor=division_5)
larger_than = LargerThan(FirstNumber=Slider(0, range=0..100), SecondNumber=deconstruct.ZComponent)  # -> LargerThan, OrEqualTo
# Shell thickness
number_slider_5 = Slider(0.4, range=0..1)
negative = Negative(Value=number_slider_4)
cluster = Cluster_4(base=curve_2, base_2=curve, mesh=mesh_3, mesh_2=mesh_3, mesh_3=mesh_3, mesh_4=mesh_3)  # -> mesh_7, mesh_8, mesh_5, mesh_6
addition = Addition(A=unit_x, B=unit_y)
addition_2 = Addition(A=unit_x_2, B=unit_y_2)
addition_3 = Addition(A=unit_x_3, B=unit_y_3)
# Wall output
weaverbird_s_mesh_thicken = WeaverbirdsMeshThicken(MeshCurves=[cluster.mesh_7, cluster.mesh_6], Distance=number_slider_4, OffsetType=0)
weaverbird_s_mesh_thicken_2 = WeaverbirdsMeshThicken(MeshCurves=[cluster.mesh_8, cluster.mesh_5], Distance=negative, OffsetType=0)
cull_pattern = CullPattern(List=meshcorners, CullPattern=larger_than.LargerThan)
boolean_toggle = BooleanToggle(False)
negative_2 = Negative(Value=number_slider_5)
average = Average(Input=cull_pattern)
weaverbird_s_mesh_thicken_3 = WeaverbirdsMeshThicken(MeshCurves=unify_mesh_2.Result, Distance=negative_2, OffsetType=0)
mesh_4 = Mesh([weaverbird_s_mesh_thicken, weaverbird_s_mesh_thicken_2])
mesh_5 = Mesh(mesh_4)
division_7 = Division(A=size_in_y, B=2)
division_8 = Division(A=size_in_y, B=2)
mesh_union = MeshUnion(Meshes=flatten([weaverbird_s_mesh_thicken_3, mesh_5]))
unit_y_4 = UnitY(Factor=division_8)
unit_x_4 = UnitX(Factor=division_7)
mesh_6 = Mesh(flatten([mesh_5, weaverbird_s_mesh_thicken_3]))
addition_4 = Addition(A=unit_y_4, B=unit_x_4)
division_9 = Division(A=size_in_z, B=2)
division_10 = Division(A=size_in_z_3, B=2)
number_7 = Number(size_in_z)
bounding_box = BoundingBox(Content=weaverbird_s_mesh_thicken_3, Plane=PlaneXY(0, 0, 0))  # -> Box, Box_2
division_11 = Division(A=size_in_z_2, B=2)
number_8 = Number(size_in_z_2)
number_9 = Number(size_in_z_3)
series = Series(Start=division_9, Step=number_7, Count=layers_in_z)
list_length = ListLength(List=series)
deconstruct_brep = DeconstructBrep(Brep=bounding_box.Box)  # -> Faces, Edges, Vertices
subtraction = Subtraction(A=list_length, B=1)
dispatch = Dispatch(List=simplify(series), DispatchPattern=[Toggle(True), Toggle(False)])  # -> simplify(flatten(ListA)), simplify(flatten(ListB))
number_10 = Number(size_in_y_3)
number_11 = Number(size_in_x_3)
curve_3 = Curve(deconstruct_brep.Edges)
curve_4 = Curve(curve_3)
curve_5 = Curve(curve_3)
curve_6 = Curve(curve_3)
cluster_2 = Cluster_2(list_3=curve_4, list=curve_4, B_2=number, list_2=curve_4, B=number_2)  # -> result_2, result
rectangular = Rectangular(Plane=xy_plane, SizeX=size_in_y, SizeY=size_in_x, ExtentX=cluster_2.result_2, ExtentY=cluster_2.result)  # -> Cells, flatten(Points)
cluster_3 = Cluster(list_3=curve_4, list=curve_4, B_2=number_2, list_2=curve_4, B=number)  # -> length_4, result_2, result
cluster_4 = Cluster_2(list_3=curve_5, list=curve_5, B_2=number_3, list_2=curve_5, B=number_4)  # -> result_2, result
rectangular_2 = Rectangular(Plane=xy_plane_2, SizeX=size_in_y_2, SizeY=size_in_x_2, ExtentX=cluster_4.result_2, ExtentY=cluster_4.result)  # -> Cells, flatten(Points)
cluster_5 = Cluster(list_3=curve_5, list=curve_5, B_2=number_4, list_2=curve_5, B=number_3)  # -> length_4, result_2, result
cluster_6 = Cluster_2(list_3=curve_6, list=curve_6, B_2=number_5, list_2=curve_6, B=number_6)  # -> result_2, result
rectangular_3 = Rectangular(Plane=xy_plane_4, SizeX=size_in_y_4, SizeY=size_in_x_4, ExtentX=cluster_6.result_2, ExtentY=cluster_6.result)  # -> Cells, flatten(Points)
cluster_7 = Cluster(list_3=curve_6, list=curve_6, B_2=number_6, list_2=curve_6, B=number_5)  # -> length_4, result_2, result

rectangular_4 = Rectangular(Plane=xy_plane_4, SizeX=size_in_x_4, SizeY=size_in_y_4, ExtentX=cluster_7.result_2, ExtentY=cluster_7.result)  # -> Cells, flatten(Points)
rectangle = Rectangle(Plane=PlaneXY(0, 0, 0), XSize=size_in_x_4, YSize=size_in_y_4, Radius=0)  # -> Rectangle, Length
area = Area(Geometry=rectangular_4.Cells)  # -> Area, Centroid
point = Point(area.Centroid)

area_2 = Area(Geometry=rectangular_2.Cells)  # -> Area, Centroid
area_3 = Area(Geometry=rectangular.Cells)  # -> Area, Centroid
area_4 = Area(Geometry=rectangular_3.Cells)  # -> Area, Centroid
average_2 = Average(Input=flatten(area_4.Centroid))
average_3 = Average(Input=flatten(area_3.Centroid))
average_4 = Average(Input=flatten(area_2.Centroid))
average_5 = Average(Input=flatten(area.Centroid))
list_item = ListItem(List=series, Index=subtraction, Wrap=True)
addition_5 = Addition(A=list_item, B=division_9)
addition_6 = Addition(A=addition_5, B=division_11)
series_2 = Series(Start=addition_6, Step=number_8, Count=layers_in_z_2)
list_length_2 = ListLength(List=series_2)
subtraction_2 = Subtraction(A=list_length_2, B=1)
dispatch_2 = Dispatch(List=simplify(series_2), DispatchPattern=[Toggle(True), Toggle(False)])  # -> simplify(flatten(ListA)), simplify(flatten(ListB))
list_item_2 = ListItem(List=series_2, Index=subtraction_2, Wrap=True)
addition_7 = Addition(A=list_item_2, B=division_11)
addition_8 = Addition(A=addition_7, B=division_10)
cluster_8 = Cluster(list_3=curve_3, list=curve_3, B_2=number_11, list_2=curve_3, B=number_10)  # -> length_4, result_2, result
rectangular_5 = Rectangular(Plane=xy_plane_3, SizeX=size_in_x_3, SizeY=size_in_y_3, ExtentX=cluster_8.result_2, ExtentY=cluster_8.result)  # -> Cells, flatten(Points)
average_6 = Average(Input=rectangular_5.Points)
point_2 = Point(average_6)
point_3 = Point(average_6)
point_4 = Point(average_6)
move_to_point = MoveToPoint(Geometry=area_4.Centroid, PointA=average_2, PointB=point_2)  # -> Moved, Vector, Transform
move = Move(Geometry=move_to_point.Moved, Motion=addition_3)  # -> Geometry, Transform
move_to_point_2 = MoveToPoint(Geometry=area.Centroid, PointA=average_5, PointB=point_2)  # -> Moved, Vector, Transform
move_to_point_3 = MoveToPoint(Geometry=area_3.Centroid, PointA=average_3, PointB=point_3)  # -> Moved, Vector, Transform
move_2 = Move(Geometry=move_to_point_3.Moved, Motion=addition)  # -> Geometry, Transform
move_to_point_4 = MoveToPoint(Geometry=area_2.Centroid, PointA=average_4, PointB=point_4)  # -> Moved, Vector, Transform
move_3 = Move(Geometry=move_to_point_4.Moved, Motion=addition_2)  # -> Geometry, Transform
point_5 = Point(move_2.Geometry)
point_6 = Point(move.Geometry)
point_7 = Point(move_3.Geometry)
move_to_point_5 = MoveToPoint(Geometry=mesh_6, PointA=average, PointB=average_6)  # -> Moved, Vector, Transform
# Total height
total_height = Number(cluster_8.length_4)
# Final mesh geometry
move_4 = Move(Geometry=move_to_point_5.Moved, Motion=addition_4)  # -> Geometry, Transform
subtraction_3 = Subtraction(A=total_height, B=addition_8)
mesh_7 = Mesh(graft(move_4.Geometry))
division_12 = Division(A=subtraction_3, B=size_in_z_3)
series_3 = Series(Start=addition_8, Step=number_9, Count=division_12)
dispatch_3 = Dispatch(List=simplify(series_3), DispatchPattern=[Toggle(True), Toggle(False)])  # -> simplify(flatten(ListA)), simplify(flatten(ListB))
mesh_8 = Mesh(mesh_7)
point_8 = Point(point_5)
point_9 = Point(point_7)
mesh_9 = Mesh(mesh_7)
point_10 = Point(point)
point_11 = Point(point_6)
mesh_10 = Mesh(mesh_7)
unit_z = UnitZ(Factor=dispatch.ListA)
unit_z_2 = UnitZ(Factor=dispatch.ListB)
unit_z_3 = UnitZ(Factor=dispatch_2.ListA)
unit_z_4 = UnitZ(Factor=dispatch_2.ListB)
unit_z_5 = UnitZ(Factor=dispatch_3.ListA)
unit_z_6 = UnitZ(Factor=dispatch_3.ListB)
deconstruct_brep_2 = DeconstructBrep(Brep=rectangle.Rectangle)  # -> Faces, Edges, Vertices
move_5 = Move(Geometry=graft(point_8), Motion=unit_z_2)  # -> simplify(flatten(Geometry)), Transform
move_6 = Move(Geometry=graft(point_9), Motion=unit_z_4)  # -> simplify(flatten(Geometry)), Transform
move_7 = Move(Geometry=graft(point_10), Motion=unit_z_5)  # -> simplify(flatten(Geometry)), Transform
move_8 = Move(Geometry=graft(point_11), Motion=unit_z_6)  # -> simplify(flatten(Geometry)), Transform
construct_mesh = ConstructMesh(Vertices=deconstruct_brep_2.Vertices, Faces={A=0, B=1, C=2, D=3})
number_12 = Number(size_in_z)
number_13 = Number(number_8)
number_14 = Number(number_9)
offset_mesh = OffsetMesh(Mesh=construct_mesh, Distance=number_14, BothSides=0, CreateSolid=True)
mesh_inclusion = MeshInclusion(Mesh=mesh_8, Point=move_5.Geometry, Strict=False)
mesh_inclusion_2 = MeshInclusion(Mesh=mesh_9, Point=move_6.Geometry, Strict=False)
mesh_inclusion_3 = MeshInclusion(Mesh=mesh_10, Point=move_7.Geometry, Strict=False)
mesh_inclusion_4 = MeshInclusion(Mesh=mesh_10, Point=move_8.Geometry, Strict=False)
rotate = Rotate(Geometry=offset_mesh, Angle=degrees(Slider(90, range=0..100)), Plane=PlaneXY(0, 0, 0))  # -> Geometry, Transform
volume = Volume(Geometry=offset_mesh)  # -> Volume, Centroid
cull_pattern_2 = CullPattern(List=move_5.Geometry, CullPattern=mesh_inclusion)
cull_pattern_3 = CullPattern(List=move_6.Geometry, CullPattern=mesh_inclusion_2)
cull_pattern_4 = CullPattern(List=move_7.Geometry, CullPattern=mesh_inclusion_3)
cull_pattern_5 = CullPattern(List=move_8.Geometry, CullPattern=mesh_inclusion_4)
remove_duplicate_points_karamba3d = RemoveDuplicatePointsKaramba3D(Point=flatten(cull_pattern_2), LimitDistance=0.005)  # -> OutPoint, Info, Indexes
remove_duplicate_points_karamba3d_2 = RemoveDuplicatePointsKaramba3D(Point=flatten(cull_pattern_3), LimitDistance=0.005)  # -> OutPoint, Info, Indexes
remove_duplicate_points_karamba3d_3 = RemoveDuplicatePointsKaramba3D(Point=flatten(cull_pattern_4), LimitDistance=0.005)  # -> OutPoint, Info, Indexes
remove_duplicate_points_karamba3d_4 = RemoveDuplicatePointsKaramba3D(Point=flatten(cull_pattern_5), LimitDistance=0.005)  # -> OutPoint, Info, Indexes
volume_2 = Volume(Geometry=rotate.Geometry)  # -> Volume, Centroid
move_to_point_6 = MoveToPoint(Geometry=offset_mesh, PointA=volume.Centroid, PointB=remove_duplicate_points_karamba3d_3.OutPoint)  # -> Moved, Vector, Transform
move_to_point_7 = MoveToPoint(Geometry=rotate.Geometry, PointA=volume_2.Centroid, PointB=remove_duplicate_points_karamba3d_4.OutPoint)  # -> Moved, Vector, Transform
mesh_11 = Mesh([move_to_point_6.Moved, move_to_point_7.Moved])

rectangular_6 = Rectangular(Plane=xy_plane, SizeX=size_in_x, SizeY=size_in_y, ExtentX=cluster_3.result_2, ExtentY=cluster_3.result)  # -> Cells, flatten(Points)
rectangle_2 = Rectangle(Plane=PlaneXY(0, 0, 0), XSize=size_in_x, YSize=size_in_y, Radius=0)  # -> Rectangle, Length
area_5 = Area(Geometry=rectangular_6.Cells)  # -> Area, Centroid

average_7 = Average(Input=flatten(area_5.Centroid))
move_to_point_8 = MoveToPoint(Geometry=area_5.Centroid, PointA=average_7, PointB=point_3)  # -> Moved, Vector, Transform

point_12 = Point(move_to_point_8.Moved)

point_13 = Point(point_12)
deconstruct_brep_3 = DeconstructBrep(Brep=rectangle_2.Rectangle)  # -> Faces, Edges, Vertices
move_9 = Move(Geometry=graft(point_13), Motion=unit_z)  # -> simplify(flatten(Geometry)), Transform
construct_mesh_2 = ConstructMesh(Vertices=deconstruct_brep_3.Vertices, Faces={A=0, B=1, C=2, D=3})
offset_mesh_2 = OffsetMesh(Mesh=construct_mesh_2, Distance=number_12, BothSides=0, CreateSolid=True)
mesh_inclusion_5 = MeshInclusion(Mesh=graft(mesh_8), Point=move_9.Geometry, Strict=False)
rotate_2 = Rotate(Geometry=offset_mesh_2, Angle=degrees(Slider(90, range=0..100)), Plane=PlaneXY(0, 0, 0))  # -> Geometry, Transform
volume_3 = Volume(Geometry=offset_mesh_2)  # -> Volume, Centroid
cull_pattern_6 = CullPattern(List=move_9.Geometry, CullPattern=mesh_inclusion_5)
remove_duplicate_points_karamba3d_5 = RemoveDuplicatePointsKaramba3D(Point=flatten(cull_pattern_6), LimitDistance=0.005)  # -> OutPoint, Info, Indexes
volume_4 = Volume(Geometry=rotate_2.Geometry)  # -> Volume, Centroid
move_to_point_9 = MoveToPoint(Geometry=offset_mesh_2, PointA=volume_3.Centroid, PointB=remove_duplicate_points_karamba3d_5.OutPoint)  # -> Moved, Vector, Transform
move_to_point_10 = MoveToPoint(Geometry=rotate_2.Geometry, PointA=volume_4.Centroid, PointB=remove_duplicate_points_karamba3d.OutPoint)  # -> Moved, Vector, Transform
# First type of birck
# Second type of birck
mesh_12 = Mesh([move_to_point_9.Moved, move_to_point_10.Moved])

rectangular_7 = Rectangular(Plane=xy_plane_2, SizeX=size_in_x_2, SizeY=size_in_y_2, ExtentX=cluster_5.result_2, ExtentY=cluster_5.result)  # -> Cells, flatten(Points)
rectangle_3 = Rectangle(Plane=PlaneXY(0, 0, 0), XSize=size_in_x_2, YSize=size_in_y_2, Radius=0)  # -> Rectangle, Length
area_6 = Area(Geometry=rectangular_7.Cells)  # -> Area, Centroid

average_8 = Average(Input=flatten(area_6.Centroid))
move_to_point_11 = MoveToPoint(Geometry=area_6.Centroid, PointA=average_8, PointB=point_4)  # -> Moved, Vector, Transform

point_14 = Point(move_to_point_11.Moved)

point_15 = Point(point_14)
deconstruct_brep_4 = DeconstructBrep(Brep=rectangle_3.Rectangle)  # -> Faces, Edges, Vertices
move_10 = Move(Geometry=graft(point_15), Motion=unit_z_3)  # -> simplify(flatten(Geometry)), Transform
construct_mesh_3 = ConstructMesh(Vertices=deconstruct_brep_4.Vertices, Faces={A=0, B=1, C=2, D=3})
offset_mesh_3 = OffsetMesh(Mesh=construct_mesh_3, Distance=number_13, BothSides=0, CreateSolid=True)
mesh_inclusion_6 = MeshInclusion(Mesh=mesh_9, Point=move_10.Geometry, Strict=False)
volume_5 = Volume(Geometry=offset_mesh_3)  # -> Volume, Centroid
rotate_3 = Rotate(Geometry=offset_mesh_3, Angle=degrees(Slider(90, range=0..100)), Plane=PlaneXY(0, 0, 0))  # -> Geometry, Transform
cull_pattern_7 = CullPattern(List=move_10.Geometry, CullPattern=mesh_inclusion_6)
remove_duplicate_points_karamba3d_6 = RemoveDuplicatePointsKaramba3D(Point=flatten(cull_pattern_7), LimitDistance=0.005)  # -> OutPoint, Info, Indexes
volume_6 = Volume(Geometry=rotate_3.Geometry)  # -> Volume, Centroid
move_to_point_12 = MoveToPoint(Geometry=offset_mesh_3, PointA=volume_5.Centroid, PointB=remove_duplicate_points_karamba3d_6.OutPoint)  # -> Moved, Vector, Transform
move_to_point_13 = MoveToPoint(Geometry=rotate_3.Geometry, PointA=volume_6.Centroid, PointB=remove_duplicate_points_karamba3d_2.OutPoint)  # -> Moved, Vector, Transform
# Third type of birck
mesh_13 = Mesh([move_to_point_12.Moved, move_to_point_13.Moved])
# Window outlines
# Final mesh geometry
# Final Brick unit
# First type of brick
# Shifting of bricks
# Second type of brick
# Shifting of bricks
# Total height
# Total height
# Total height
# Third type of brick
# Third type of brick
# Shifting of bricks
# Shifting of bricks
# Shifting of bricks
geometry = Geometry([mesh_12, mesh_13, mesh_11])

# ==== cluster Cluster
list = ClusterInput()

# ---- group: X direction
list_item = ListItem(List=list, Index=Slider(0, range=0..10), Wrap=True)
length = Length(Curve=list_item)

# ----
list_2 = ClusterInput()

# ---- group: Y direction
list_item_2 = ListItem(List=list_2, Index=Slider(1, range=0..10), Wrap=True)
length_2 = Length(Curve=list_item_2)

# ----
list_3 = ClusterInput()
list_item_3 = ListItem(List=list_3, Index=Slider(8, range=0..10), Wrap=True)
length_3 = Length(Curve=list_item_3)
B = ClusterInput()
B_2 = ClusterInput()
division = Division(A=length_2, B=B)
division_2 = Division(A=length, B=B_2)
length_4 = ClusterOutput(length_3)
multiplication = Multiplication(A=division, B=Slider(1.2, range=0..10))
multiplication_2 = Multiplication(A=division_2, B=Slider(1.2, range=0..10))
result = ClusterOutput(multiplication)
result_2 = ClusterOutput(multiplication_2)

# ==== cluster Cluster_2
list = ClusterInput()

# ---- group: X direction
list_item = ListItem(List=list, Index=Slider(0, range=0..10), Wrap=True)
length = Length(Curve=list_item)

# ----
list_2 = ClusterInput()

# ---- group: Y direction
list_item_2 = ListItem(List=list_2, Index=Slider(1, range=0..10), Wrap=True)
length_2 = Length(Curve=list_item_2)

# ----
list_3 = ClusterInput()
list_item_3 = ListItem(List=list_3, Index=Slider(8, range=0..10), Wrap=True)
length_3 = Length(Curve=list_item_3)
B = ClusterInput()
B_2 = ClusterInput()
division = Division(A=length_2, B=B)
division_2 = Division(A=length, B=B_2)
multiplication = Multiplication(A=division, B=Slider(1.2, range=0..10))
multiplication_2 = Multiplication(A=division_2, B=Slider(1.2, range=0..10))
result = ClusterOutput(multiplication)
result_2 = ClusterOutput(multiplication_2)

# ==== cluster Cluster_4
mesh = ClusterInput()
mesh_2 = ClusterInput()
mesh_3 = ClusterInput()
mesh_4 = ClusterInput()
base = ClusterInput()
base_2 = ClusterInput()
cluster = Cluster_3(mesh=mesh, mesh_2=mesh_2, mesh_3=mesh_3, mesh_4=mesh_4)  # -> i, i_2, set, set_2
boolean_toggle = BooleanToggle(True)
delete_consecutive = DeleteConsecutive(Set=cluster.i, Wrap=False)  # -> Set, Count
delete_consecutive_2 = DeleteConsecutive(Set=cluster.i_2, Wrap=False)  # -> Set, Count
unit_y = UnitY(Factor=1)
polyline = PolyLine(Vertices=delete_consecutive.Set, Closed=boolean_toggle)
polyline_2 = PolyLine(Vertices=delete_consecutive_2.Set, Closed=boolean_toggle)
boolean_toggle_2 = BooleanToggle(True)
extrude = Extrude(Base=base, Direction=unit_y)
extrude_2 = Extrude(Base=base_2, Direction=unit_y)
boundary_surfaces = BoundarySurfaces(Edges=flatten(polyline_2))
boundary_surfaces_2 = BoundarySurfaces(Edges=flatten(polyline))
polyline_3 = PolyLine(Vertices=cluster.set, Closed=boolean_toggle_2)
polyline_4 = PolyLine(Vertices=cluster.set_2, Closed=boolean_toggle_2)
brep_brep = BrepBrep(BrepA=extrude, BrepB=boundary_surfaces_2)  # -> Curves, Points
brep_brep_2 = BrepBrep(BrepA=extrude_2, BrepB=boundary_surfaces)  # -> Curves, Points
boundary_surfaces_3 = BoundarySurfaces(Edges=polyline_3)
boundary_surfaces_4 = BoundarySurfaces(Edges=polyline_4)
boundary_surfaces_5 = BoundarySurfaces(Edges=flatten([brep_brep.Curves, polyline]))
mesh_brep = MeshBrep(
    Brep=boundary_surfaces_3,
    Settings={GridMaxCount=0, GridMinCount=16, JaggedSeams=False, MaxEdgeLength=0, MinEdgeLength=0.0001, MinTolerance=0, Refine=True, RefineAngle=0, RelativeTolerance=0.65, SimplePlanes=True, Tolerance=0})
mesh_5 = ClusterOutput(mesh_brep)
mesh_brep_2 = MeshBrep(
    Brep=boundary_surfaces_4,
    Settings={GridMaxCount=0, GridMinCount=16, JaggedSeams=False, MaxEdgeLength=0, MinEdgeLength=0.0001, MinTolerance=0, Refine=True, RefineAngle=0, RelativeTolerance=0.65, SimplePlanes=True, Tolerance=0})
mesh_6 = ClusterOutput(mesh_brep_2)
boundary_surfaces_6 = BoundarySurfaces(Edges=flatten([brep_brep_2.Curves, polyline_2]))
mesh_brep_3 = MeshBrep(
    Brep=boundary_surfaces_5,
    Settings={GridMaxCount=0, GridMinCount=16, JaggedSeams=False, MaxEdgeLength=0, MinEdgeLength=0.0001, MinTolerance=0, Refine=True, RefineAngle=0, RelativeTolerance=0.65, SimplePlanes=True, Tolerance=0})
mesh_7 = ClusterOutput(mesh_brep_3)
mesh_brep_4 = MeshBrep(
    Brep=boundary_surfaces_6,
    Settings={GridMaxCount=0, GridMinCount=16, JaggedSeams=False, MaxEdgeLength=0, MinEdgeLength=0.0001, MinTolerance=0, Refine=True, RefineAngle=0, RelativeTolerance=0.65, SimplePlanes=True, Tolerance=0})
mesh_8 = ClusterOutput(mesh_brep_4)

# ==== cluster Cluster_3
mesh = ClusterInput()
mesh_2 = ClusterInput()
mesh_3 = ClusterInput()
mesh_4 = ClusterInput()
mesh_edges = MeshEdges(Mesh=mesh)  # -> NakedEdges, InteriorEdges, NonManifoldEdges
mesh_edges_2 = MeshEdges(Mesh=mesh_2)  # -> NakedEdges, InteriorEdges, NonManifoldEdges
mesh_edges_3 = MeshEdges(Mesh=mesh_3)  # -> NakedEdges, InteriorEdges, NonManifoldEdges
mesh_edges_4 = MeshEdges(Mesh=mesh_4)  # -> NakedEdges, InteriorEdges, NonManifoldEdges
curve = Curve(mesh_edges.NakedEdges)
curve_2 = Curve(mesh_edges_2.NakedEdges)
curve_3 = Curve(mesh_edges_3.NakedEdges)
curve_4 = Curve(mesh_edges_4.NakedEdges)
end_points = EndPoints(Curve=curve)  # -> Start, End
end_points_2 = EndPoints(Curve=curve_2)  # -> Start, End
end_points_3 = EndPoints(Curve=curve_3)  # -> Start, End
end_points_4 = EndPoints(Curve=curve_4)  # -> Start, End
point = Point([end_points.End, end_points.Start])
point_2 = Point([end_points_2.End, end_points_2.Start])
point_3 = Point([end_points_3.End, end_points_3.Start])
point_4 = Point([end_points_4.End, end_points_4.Start])
delete_consecutive = DeleteConsecutive(Set=point, Wrap=False)  # -> Set, Count
delete_consecutive_2 = DeleteConsecutive(Set=point_2, Wrap=False)  # -> Set, Count
delete_consecutive_3 = DeleteConsecutive(Set=point_3, Wrap=False)  # -> Set, Count
delete_consecutive_4 = DeleteConsecutive(Set=point_4, Wrap=False)  # -> Set, Count
list_length = ListLength(List=delete_consecutive.Set)
list_length_2 = ListLength(List=delete_consecutive_2.Set)
list_length_3 = ListLength(List=delete_consecutive_3.Set)
list_length_4 = ListLength(List=delete_consecutive_4.Set)
deconstruct = Deconstruct(Point=delete_consecutive_2.Set)  # -> XComponent, YComponent, ZComponent
deconstruct_2 = Deconstruct(Point=delete_consecutive_3.Set)  # -> XComponent, YComponent, ZComponent
deconstruct_3 = Deconstruct(Point=delete_consecutive_4.Set)  # -> XComponent, YComponent, ZComponent
deconstruct_4 = Deconstruct(Point=delete_consecutive.Set)  # -> XComponent, YComponent, ZComponent
series = Series(Start=0, Step=1, Count=list_length)
series_2 = Series(Start=0, Step=1, Count=list_length_2)
series_3 = Series(Start=0, Step=1, Count=list_length_3)
series_4 = Series(Start=0, Step=1, Count=list_length_4)
sort_list = SortList(Keys=deconstruct.YComponent, ValuesValuesA=series_2)  # -> Keys, reverse(ValuesValuesA)
number_slider = Slider(43, range=0..100)
sort_list_2 = SortList(Keys=deconstruct_4.YComponent, ValuesValuesA=series)  # -> Keys, ValuesValuesA
number_slider_2 = Slider(45, range=0..100)
sort_list_3 = SortList(Keys=deconstruct_2.XComponent, ValuesValuesA=series_3)  # -> Keys, reverse(ValuesValuesA)
sort_list_4 = SortList(Keys=deconstruct_3.XComponent, ValuesValuesA=series_4)  # -> Keys, ValuesValuesA
split_list = SplitList(List=sort_list.ValuesValuesA, Index=number_slider)  # -> ListA, ListB
split_list_2 = SplitList(List=sort_list_2.ValuesValuesA, Index=number_slider)  # -> ListA, ListB
split_list_3 = SplitList(List=sort_list_3.ValuesValuesA, Index=number_slider_2)  # -> ListA, ListB
split_list_4 = SplitList(List=sort_list_4.ValuesValuesA, Index=number_slider_2)  # -> ListA, ListB
list_item = ListItem(List=delete_consecutive_2.Set, Index=split_list.ListA, Wrap=True)
list_length_5 = ListLength(List=list_item)
deconstruct_5 = Deconstruct(Point=list_item)  # -> XComponent, YComponent, ZComponent
list_item_2 = ListItem(List=delete_consecutive.Set, Index=split_list_2.ListA, Wrap=True)
series_5 = Series(Start=0, Step=1, Count=list_length_5)
list_length_6 = ListLength(List=list_item_2)
list_item_3 = ListItem(List=delete_consecutive_3.Set, Index=split_list_3.ListA, Wrap=True)
list_length_7 = ListLength(List=list_item_3)
list_item_4 = ListItem(List=delete_consecutive_4.Set, Index=split_list_4.ListA, Wrap=True)
list_length_8 = ListLength(List=list_item_4)
average = Average(Input=list_item)
number_slider_3 = Slider(23, range=0..100)
average_2 = Average(Input=list_item_4)
average_3 = Average(Input=list_item_2)
deconstruct_6 = Deconstruct(Point=list_item_2)  # -> XComponent, YComponent, ZComponent
sort_list_5 = SortList(Keys=deconstruct_5.ZComponent, ValuesValuesA=series_5)  # -> Keys, reverse(ValuesValuesA)
deconstruct_7 = Deconstruct(Point=list_item_3)  # -> XComponent, YComponent, ZComponent
series_6 = Series(Start=0, Step=1, Count=list_length_6)
average_4 = Average(Input=list_item_3)
deconstruct_8 = Deconstruct(Point=list_item_4)  # -> XComponent, YComponent, ZComponent
series_7 = Series(Start=0, Step=1, Count=list_length_7)
series_8 = Series(Start=0, Step=1, Count=list_length_8)
sort_list_6 = SortList(Keys=deconstruct_6.ZComponent, ValuesValuesA=series_6)  # -> Keys, reverse(ValuesValuesA)
sort_list_7 = SortList(Keys=deconstruct_7.ZComponent, ValuesValuesA=series_7)  # -> Keys, reverse(ValuesValuesA)
list_item_5 = ListItem(List=sort_list_5.ValuesValuesA, Index=Slider(0, range=0..1), Wrap=True)
sort_list_8 = SortList(Keys=deconstruct_8.ZComponent, ValuesValuesA=series_8)  # -> Keys, reverse(ValuesValuesA)
list_item_6 = ListItem(List=list_item, Index=list_item_5, Wrap=True)
closest_points = ClosestPoints(Point=list_item_6, Cloud=list_item, Count=Slider(22, range=0..100))  # -> ClosestPoint, CPIndex, Distance
list_item_7 = ListItem(List=sort_list_6.ValuesValuesA, Index=Slider(0, range=0..1), Wrap=True)
list_item_8 = ListItem(List=sort_list_7.ValuesValuesA, Index=Slider(0, range=0..1), Wrap=True)
list_item_9 = ListItem(List=sort_list_8.ValuesValuesA, Index=Slider(0, range=0..1), Wrap=True)
list_length_9 = ListLength(List=closest_points.ClosestPoint)
list_item_10 = ListItem(List=list_item_2, Index=list_item_7, Wrap=True)
closest_points_2 = ClosestPoints(Point=list_item_10, Cloud=list_item_2, Count=Slider(21, range=0..100))  # -> ClosestPoint, CPIndex, Distance
list_length_10 = ListLength(List=closest_points_2.ClosestPoint)
deconstruct_9 = Deconstruct(Point=closest_points_2.ClosestPoint)  # -> XComponent, YComponent, ZComponent
list_item_11 = ListItem(List=list_item_3, Index=list_item_8, Wrap=True)
closest_points_3 = ClosestPoints(Point=list_item_11, Cloud=list_item_3, Count=number_slider_3)  # -> ClosestPoint, CPIndex, Distance
deconstruct_10 = Deconstruct(Point=closest_points_3.ClosestPoint)  # -> XComponent, YComponent, ZComponent
list_length_11 = ListLength(List=closest_points_3.ClosestPoint)
deconstruct_11 = Deconstruct(Point=closest_points.ClosestPoint)  # -> XComponent, YComponent, ZComponent
list_item_12 = ListItem(List=list_item_4, Index=list_item_9, Wrap=True)
closest_points_4 = ClosestPoints(Point=list_item_12, Cloud=list_item_4, Count=number_slider_3)  # -> ClosestPoint, CPIndex, Distance
deconstruct_12 = Deconstruct(Point=closest_points_4.ClosestPoint)  # -> XComponent, YComponent, ZComponent
list_length_12 = ListLength(List=closest_points_4.ClosestPoint)
series_9 = Series(Start=0, Step=1, Count=list_length_10)
series_10 = Series(Start=0, Step=1, Count=list_length_9)
series_11 = Series(Start=0, Step=1, Count=list_length_11)
series_12 = Series(Start=0, Step=1, Count=list_length_12)
sort_list_9 = SortList(Keys=deconstruct_9.XComponent, ValuesValuesA=series_9)  # -> Keys, ValuesValuesA
sort_list_10 = SortList(Keys=deconstruct_11.XComponent, ValuesValuesA=series_10)  # -> Keys, ValuesValuesA
sort_list_11 = SortList(Keys=deconstruct_10.YComponent, ValuesValuesA=series_11)  # -> Keys, ValuesValuesA
sort_list_12 = SortList(Keys=deconstruct_12.YComponent, ValuesValuesA=series_12)  # -> Keys, ValuesValuesA
list_item_13 = ListItem(List=closest_points_2.ClosestPoint, Index=sort_list_9.ValuesValuesA, Wrap=True)
list_item_14 = ListItem(List=closest_points_3.ClosestPoint, Index=sort_list_11.ValuesValuesA, Wrap=True)
list_item_15 = ListItem(List=closest_points.ClosestPoint, Index=sort_list_10.ValuesValuesA, Wrap=True)
list_item_16 = ListItem(List=closest_points_4.ClosestPoint, Index=sort_list_12.ValuesValuesA, Wrap=True)
list_length_13 = ListLength(List=list_item_14)
i = ClusterOutput(list_item_13)
list_length_14 = ListLength(List=list_item_16)
i_2 = ClusterOutput(list_item_15)
division = Division(A=list_length_13, B=2)
division_2 = Division(A=list_length_14, B=2)
split_list_5 = SplitList(List=list_item_14, Index=division)  # -> ListA, ListB
split_list_6 = SplitList(List=list_item_16, Index=division_2)  # -> ListA, ListB
point_5 = Point(split_list_5.ListB)
point_6 = Point(split_list_5.ListA)
point_7 = Point(split_list_6.ListB)
point_8 = Point(split_list_6.ListA)
list_length_15 = ListLength(List=point_5)
list_length_16 = ListLength(List=point_6)
list_length_17 = ListLength(List=point_7)
list_length_18 = ListLength(List=point_8)
deconstruct_13 = Deconstruct(Point=point_5)  # -> XComponent, YComponent, ZComponent
deconstruct_14 = Deconstruct(Point=point_6)  # -> XComponent, YComponent, ZComponent
deconstruct_15 = Deconstruct(Point=point_7)  # -> XComponent, YComponent, ZComponent
deconstruct_16 = Deconstruct(Point=point_8)  # -> XComponent, YComponent, ZComponent
series_13 = Series(Start=0, Step=1, Count=list_length_15)
series_14 = Series(Start=0, Step=1, Count=list_length_16)
series_15 = Series(Start=0, Step=1, Count=list_length_17)
series_16 = Series(Start=0, Step=1, Count=list_length_18)
sort_list_13 = SortList(Keys=deconstruct_13.ZComponent, ValuesValuesA=series_13)  # -> Keys, ValuesValuesA
sort_list_14 = SortList(Keys=deconstruct_14.ZComponent, ValuesValuesA=series_14)  # -> Keys, ValuesValuesA
sort_list_15 = SortList(Keys=deconstruct_15.ZComponent, ValuesValuesA=series_15)  # -> Keys, ValuesValuesA
sort_list_16 = SortList(Keys=deconstruct_16.ZComponent, ValuesValuesA=series_16)  # -> Keys, ValuesValuesA
list_item_17 = ListItem(List=point_5, Index=sort_list_13.ValuesValuesA, Wrap=True)
list_item_18 = ListItem(List=point_6, Index=sort_list_14.ValuesValuesA, Wrap=True)  # -> reverse(Item)
list_item_19 = ListItem(List=point_7, Index=sort_list_15.ValuesValuesA, Wrap=True)
list_item_20 = ListItem(List=point_8, Index=sort_list_16.ValuesValuesA, Wrap=True)  # -> reverse(Item)
point_9 = Point([list_item_18, list_item_17])
point_10 = Point([list_item_20, list_item_19])
delete_consecutive_5 = DeleteConsecutive(Set=point_9, Wrap=False)  # -> Set, Count
delete_consecutive_6 = DeleteConsecutive(Set=point_10, Wrap=False)  # -> Set, Count
set = ClusterOutput(delete_consecutive_5.Set)
set_2 = ClusterOutput(delete_consecutive_6.Set)
